# Grasshopper definition RozvanyCompute02.gh (Grasshopper 1.0.7)

grid_size = Slider(0.7, range=0..1.2)
X = Slider(11, range=5..20)
Y = Slider(10, range=5..20)

spacing = GetNumber(grid_size, AtLeast=1, AtMost=2147483647, Maximum=1.797693135e+308, Minimum=-1.797693135e+308)
xdim = GetNumber(X, AtLeast=1, AtMost=2147483647, Maximum=1.797693135e+308, Minimum=-1.797693135e+308)
ydim = GetNumber(Y, AtLeast=1, AtMost=2147483647, Maximum=1.797693135e+308, Minimum=-1.797693135e+308)
topfix = GetInteger(Slider(0, range=-1..1), AtLeast=1, AtMost=2147483647, Maximum=2147483647, Minimum=-2147483648)
rightfix = GetInteger(Slider(0, range=-1..1), AtLeast=1, AtMost=2147483647, Maximum=2147483647, Minimum=-2147483648)
leftfix = GetInteger(Slider(1, range=-1..1), AtLeast=1, AtMost=2147483647, Maximum=2147483647, Minimum=-2147483648)
bottomfix = GetInteger(Slider(0, range=-1..1), AtLeast=1, AtMost=2147483647, Maximum=2147483647, Minimum=-2147483648)
merge = Merge(Data1=bottomfix, Data2=rightfix, Data3=topfix, Data4=leftfix)

# ----
# Boundary Shape
X_2 = UnitX(Factor=xdim)
Y_2 = UnitY(Factor=ydim)
vec = VectorXYZ(XComponent=X_2, YComponent=Y_2, ZComponent=0)  # -> Vector, Length
int = Integer(merge)
pt = ConstructPoint(XCoordinate=0, YCoordinate=0, ZCoordinate=0)
move = Move(Geometry=pt, Motion=X_2)  # -> Geometry, Transform
move_2 = Move(Geometry=pt, Motion=Y_2)  # -> Geometry, Transform
move_3 = Move(Geometry=pt, Motion=vec.Vector)  # -> Geometry, Transform
pline = PolyLine(Vertices=[pt, move.Geometry, move_3.Geometry, move_2.Geometry], Closed=invert(False))
area = Area(Geometry=pline)  # -> Area, Centroid
pdecon = Deconstruct(Point=area.Centroid)  # -> XComponent, YComponent, ZComponent
vec_2 = VectorXYZ(XComponent=expr("x*1.5", pdecon.XComponent), YComponent=pdecon.YComponent, ZComponent=pdecon.ZComponent)  # -> Vector, Length
neg = Negative(Value=vec_2.Vector)
move_4 = Move(Geometry=pline, Motion=neg)  # -> Geometry, Transform

explode = Explode(Curve=move_4.Geometry, Recursive=True)  # -> Segments, Vertices

int_2 = Integer(merge)
int_3 = Integer(Slider(-1, range=-2..1))
mindex = MemberIndex(Set=int_2, Member=int_3)  # -> Index, Count
replace = ReplaceItems(List=merge, Item=-5, Indices=mindex.Index, Wrap=False)
shift = ShiftList(List=replace, Shift=1, Wrap=True)
expression = Expression(x=replace, y=shift, z=replace, Expression="if((x=-5) and (y=-5), z-5, z)")
shift_2 = ShiftList(List=expression, Shift=1, Wrap=True)
subtraction = Subtraction(A=expression, B=shift_2)
shift_3 = ShiftList(List=subtraction, Shift=-1, Wrap=True)
expression_2 = Expression(x=shift_3, Expression="if(x=0, 0, if(x=1, 1, if(x=-1, 2, 3)))")

cull_i = CullIndex(List=explode.Vertices, Indices=-1, Wrap=True)

explode_2 = Explode(Curve=move_4.Geometry, Recursive=True)  # -> Segments, Vertices
cull_i_2 = CullIndex(List=explode_2.Vertices, Indices=-1, Wrap=True)
shift_4 = ShiftList(List=explode_2.Segments, Shift=1, Wrap=True)
vec_3 = Vector(shift_4)
vec_4 = Vector(explode_2.Segments)
angle = Angle(VectorA=vec_4, VectorB=vec_3)  # -> Angle, Reflex
expression_3 = Expression(Expression="pi/2 - atan(sqrt(2))")
expression_4 = Expression(Expression="atan(sqrt(2))")
Z = UnitZ(Factor=1)
Z_2 = UnitZ(Factor=1)
Z_3 = UnitZ(Factor=1)
vrot = Rotate(Vector=vec_4, Axis=Z, Angle=expr("x/2", angle.Angle))
vrot_2 = Rotate(Vector=vec_4, Axis=Z_3, Angle=expression_3)
vrot_3 = Rotate(Vector=vec_4, Axis=Z_2, Angle=expression_4)
p_n_c = PickNChoose(Pattern=expression_2, Stream0=vrot, Stream1=vrot_2, Stream2=vrot_3)

expression_5 = Expression(x=merge, Expression="if(x=-1, 1, 0)")
ma = MassAddition(Input=expression_5)  # -> Result, PartialResults
expression_6 = Expression(x=ma.Result, Expression="if(x>0, 1, 0)")
item = ListItem(List=explode_2.Segments, Index=mindex.Index, Wrap=True)
geo = Geometry(explode_2.Segments)
free = Relay()
pinned = Relay()
fixed = Relay()
c_script = CSharpScript(geom=pinned, key="myName", value="pinned")  # -> out, A; inputs geom: list of Curve, key: String, value: String
# ---------- c_script: C# usings ----------
using System.IO;
using System.Linq;
using System.Data;
using System.Drawing;
using System.Reflection;
using System.Windows.Forms;
using System.Xml;
using System.Xml.Linq;
using System.Runtime.InteropServices;

using Rhino.DocObjects;
using Rhino.Collections;
using GH_IO;
using GH_IO.Serialization;
# ---------- c_script: C# ----------
    for (int i = 0; i < geom.Count; i++){
      geom[i].SetUserString(_key, _value);
      A = geom;
    }
# ---------- end c_script ----------
c_script_2 = CSharpScript(geom=fixed, key="myName", value="fixed")  # -> out, A; inputs geom: list of Curve, key: String, value: String; same code as c_script
c_script_3 = CSharpScript(geom=free, key="myName", value="free")  # -> out, A; inputs geom: list of Curve, key: String, value: String; same code as c_script

# ---- group: RH_OUT:pinned
crv = Curve(c_script.A)

# ---- group: RH_OUT:fixed
crv_2 = Curve(c_script_2.A)

# ---- group: RH_OUT:free
crv_3 = Curve(c_script_3.A)

# ----
line = LineSDL(Start=cull_i_2, Direction=p_n_c, Length=1)
shift_5 = ShiftList(List=line, Shift=1, Wrap=True)
llx = LineLine(Line1=line, Line2=shift_5)  # -> ParamA, ParamB, PointA, PointB
ln = Line(StartPoint=llx.PointA, EndPoint=cull_i_2)
shift_6 = ShiftList(List=ln, Shift=1, Wrap=True)
ccx = CurveCurve(CurveA=ln, CurveB=shift_6)  # -> Points, ParamsA, ParamsB

# ----
# Junction Center
ccx_2 = CurveCurve(CurveA=ln, CurveB=shift_6)  # -> flatten(Points), ParamsA, ParamsB

cullpt = CullDuplicates(Points=ccx_2.Points, Tolerance=0.1, CullMode=1)  # -> Points, Indices, Valence

unflatten = UnflattenTree(Tree=cullpt.Points, Guide=ccx.Points)
prune = PruneTree(Tree=unflatten, Minimum=1, Maximum=0)

filter = StreamFilter(Gate=expression_6, Stream0=prune, Stream1=llx.PointA)
null = NullItem(Item=filter)  # -> NullFlags, InvalidFlags, Description
not = GateNot(A=null.NullFlags)
cull = CullPattern(List=filter, CullPattern=not)
crv_cp = CurveClosestPoint(Point=cull, Curve=explode_2.Segments)  # -> Point, Parameter, Distance
ln_2 = Line(StartPoint=cull, EndPoint=crv_cp.Point)
prune_2 = PruneTree(Tree=ln_2, Minimum=1, Maximum=0)
vec_5 = Vector(prune_2)
null_2 = NullItem(Item=vec_5)  # -> NullFlags, InvalidFlags, Description
not_2 = GateNot(A=null_2.NullFlags)
cull_2 = CullPattern(List=vec_5, CullPattern=not_2)
multiplication = Multiplication(A=cull_2, B="0.5")
len = Length(Curve=prune_2)
null_3 = NullItem(Item=len)  # -> NullFlags, InvalidFlags, Description
not_3 = GateNot(A=null_3.NullFlags)
move_5 = Move(Geometry=cull, Motion=cull_2)  # -> Geometry, Transform
move_6 = Move(Geometry=cull, Motion=multiplication)  # -> Geometry, Transform
cull_3 = CullPattern(List=len, CullPattern=not_3)  # -> flatten(List)
unflatten_2 = UnflattenTree(Tree=cull_3, Guide=prune_2)

# ----
# Line Lengths
expression_7 = Expression(x=int, y=unflatten_2, Expression="if(x=0,y*sqrt(2), if(x=1, y, z)) ")

cset = CreateSet(List=expression_7)  # -> Set, Map
mindex_2 = MemberIndex(Set=expression_7, Member=cset.Set)  # -> Index, Count
lng = ListLength(List=mindex_2.Index)

# ----
# Associated support indexes
expression_8 = Expression(x=lng, y=mindex_2.Index, Expression="if(x≥3, y, \"error\")")
prune_3 = PruneTree(Tree=expression_8, Minimum=2, Maximum=0)  # -> simplify(Tree)

tstat = TreeStatistics(Tree=prune_3)  # -> Paths, Length, Count
shift_7 = ShiftList(List=tstat.Paths, Shift=1, Wrap=True)
shift_8 = ShiftList(List=prune_3, Shift=1, Wrap=True)
branch = TreeBranch(Tree=prune_3, Path=flatten(tstat.Paths), MaintainPaths=True)
branch_2 = TreeBranch(Tree=prune_3, Path=shift_7, MaintainPaths=False)
intersection = SetIntersection(SetA=branch, SetB=branch_2)
item_2 = ListItem(List=geo, Index=prune_3, Wrap=True)
item_3 = ListItem(List=geo, Index=shift_8, Wrap=True)
llx_2 = LineLine(Line1=item_2, Line2=item_3)  # -> ParamA, ParamB, PointA, PointB

# ----
# Junction Vertices
expression_9 = Expression(x=int, y=move_5.Geometry, z=move_6.Geometry, u=move_6.Geometry, Expression="if(x=0, y, if(x=1, z, u))")

null_4 = NullItem(Item=expression_9)  # -> NullFlags, InvalidFlags, Description
not_4 = GateNot(A=null_4.NullFlags)
cull_4 = CullPattern(List=expression_9, CullPattern=not_4)
prune_4 = PruneTree(Tree=cull_4, Minimum=1, Maximum=0)  # -> flatten(Tree)
unflatten_3 = UnflattenTree(Tree=prune_4, Guide=expression_9)

item_4 = ListItem(List=unflatten_3, Index=prune_3, Wrap=True)

shift_9 = ShiftList(List=item_4, Shift=1, Wrap=True)

# ----
# Junction Center Lines
ln_3 = Line(StartPoint=item_4, EndPoint=shift_9)

preview = CustomPreview(Geometry=ln_3, Material=ColourSwatch(SwatchColor=RGB(255, 15, 243)))
crv_cp_2 = CurveClosestPoint(Point=item_4, Curve=item)  # -> Point, Parameter, Distance
ln_4 = Line(StartPoint=item_4, EndPoint=crv_cp_2.Point)
sort = SortList(Keys=ln_4)  # -> Keys, ValuesA
item_5 = ListItem(List=unflatten_3, Index=shift_8, Wrap=True)
item_6 = ListItem(List=unflatten_3, Index=prune_3, Wrap=True)
item_7 = ListItem(List=sort.Keys, Index=-1, Wrap=True)
len_2 = Length(Curve=ln_4)
item_8 = ListItem(List=unflatten_3, Index=intersection, Wrap=True)
mindex_3 = MemberIndex(Set=len_2, Member=item_7)  # -> Index, Count
bang = ExplodeTree(Data=item_8)  # -> _000000000, _000000002
ln_5 = Line(StartPoint=llx_2.PointA, EndPoint=item_6)  # -> flatten(Line)
ln_6 = Line(StartPoint=llx_2.PointA, EndPoint=item_5)  # -> flatten(Line)
null_5 = NullItem(Item=ln_5)  # -> NullFlags, InvalidFlags, Description
null_6 = NullItem(Item=ln_6)  # -> NullFlags, InvalidFlags, Description

# ----
# Internal branches
ln_7 = Line(StartPoint=bang._000000000, EndPoint=bang._000000002)

not_5 = GateNot(A=null_5.NullFlags)
not_6 = GateNot(A=null_6.NullFlags)
preview_2 = CustomPreview(Geometry=ln_7, Material=ColourSwatch(SwatchColor=RGB(255, 238, 0)))

# ----
# edge branches
cull_i_3 = CullIndex(List=ln_4, Indices=mindex_3.Index, Wrap=True)  # -> flatten(List)
cull_5 = CullPattern(List=ln_6, CullPattern=not_6)
cull_6 = CullPattern(List=ln_5, CullPattern=not_5)

clean = CleanTree(RemoveNulls=True, RemoveInvalid=True, RemoveEmpty=False, Tree=[cull_6, cull_5, cull_i_3])
preview_3 = CustomPreview(Geometry=[cull_i_3, cull_5, cull_6], Material=ColourSwatch(SwatchColor=RGB(255, 170, 0)))
c_script_4 = CSharpScript(geom=clean, key="myName", value="edge")  # -> out, A; inputs geom: list of Curve, key: String, value: String; same code as c_script
c_script_5 = CSharpScript(geom=ln_7, key="myName", value="internal")  # -> out, A; inputs geom: list of Curve, key: String, value: String; same code as c_script
c_script_6 = CSharpScript(geom=ln_3, key="myName", value="junction")  # -> out, A; inputs geom: list of Curve, key: String, value: String; same code as c_script

divdist = DivideDistance(Curve=ln_7, Distance=spacing)  # -> Points, Tangents, Parameters
cull_i_4 = CullIndex(List=divdist.Points, Indices=0, Wrap=True)
avr = Average(Input=cull_i_4)  # -> simplify(ArithmeticMean)
midpt = CurveMiddle(Curve=ln_7)
vec2pt = Vector2Pt(PointA=avr, PointB=graft(midpt), Unitize=False)  # -> Vector, Length
bang_2 = ExplodeTree(Data=intersection)  # -> Branch0, Branch1
move_7 = Move(Geometry=cull_i_4, Motion=vec2pt.Vector)  # -> Geometry, Transform
item_9 = ListItem(List=geo, Index=bang_2.Branch0, Wrap=True)
Z_4 = UnitZ(Factor=1)
vec_6 = Vector(item_9)
vrot_4 = Rotate(Vector=vec_6, Axis=Z_4, Angle=-1.570796327)
line_2 = LineSDL(Start=move_7.Geometry, Direction=graft(vrot_4), Length=1)
llx_3 = LineLine(Line1=line_2, Line2=graft(item_9))  # -> ParamA, ParamB, PointA, PointB
ln_8 = Line(StartPoint=llx_3.PointA, EndPoint=move_7.Geometry)
flip = FlipCurve(Curve=ln_8)  # -> Curve, Flag
preview_4 = CustomPreview(Geometry=flip.Curve, Material=ColourSwatch(SwatchColor=RGB(0, 225, 255)))

end = EndPoints(Curve=cull_6)  # -> Start, End
end_2 = EndPoints(Curve=cull_5)  # -> Start, End
ln_9 = Line(StartPoint=end.End, EndPoint=end.Start)
ln_10 = Line(StartPoint=end_2.End, EndPoint=end_2.Start)
end_3 = EndPoints(Curve=ln_10)  # -> Start, End
end_4 = EndPoints(Curve=ln_9)  # -> Start, End
vec2pt_2 = Vector2Pt(PointA=end_4.Start, PointB=end_3.Start, Unitize=False)  # -> Vector, Length
divdist_2 = DivideDistance(Curve=ln_9, Distance=spacing)  # -> Points, Tangents, Parameters
line_3 = LineSDL(Start=divdist_2.Points, Direction=graft(vec2pt_2.Vector), Length=1)
llx_4 = LineLine(Line1=line_3, Line2=graft(ln_10))  # -> ParamA, ParamB, PointA, PointB
ln_11 = Line(StartPoint=divdist_2.Points, EndPoint=llx_4.PointA)
cull_i_5 = CullIndex(List=ln_11, Indices=0, Wrap=True)
preview_5 = CustomPreview(Geometry=cull_i_5, Material=ColourSwatch(SwatchColor=RGB(0, 0, 0)))

# ---- group: RH_OUT:edge
crv_4 = Curve(c_script_4.A)

# ---- group: RH_OUT:internal
crv_5 = Curve(c_script_5.A)

# ---- group: RH_OUT:junction
crv_6 = Curve(c_script_6.A)

# ----
bang_3 = ExplodeTree(Data=move_7.Geometry)  # -> _00000000000, _00000000010
ln_12 = Line(StartPoint=bang_3._00000000000, EndPoint=bang_3._00000000010)
preview_6 = CustomPreview(Geometry=ln_12, Material=ColourSwatch(SwatchColor=RGB(93, 0, 255)))

null_7 = NullItem(Item=llx_2.PointA)  # -> NullFlags, InvalidFlags, Description
shift_10 = ShiftList(List=prune_3, Shift=1, Wrap=True)
not_7 = GateNot(A=null_7.NullFlags)
cull_7 = CullPattern(List=shift_10, CullPattern=not_7)
item_10 = ListItem(List=geo, Index=cull_7, Wrap=True)
Z_5 = UnitZ(Factor=1)
vec_7 = Vector(item_10)
vrot_5 = Rotate(Vector=vec_7, Axis=Z_5, Angle=-1.570796327)  # -> graft(Vector)
line_4 = LineSDL(Start=llx_4.PointA, Direction=vrot_5, Length=1)
llx_5 = LineLine(Line1=line_4, Line2=graft(item_10))  # -> ParamA, ParamB, PointA, PointB
ln_13 = Line(StartPoint=llx_4.PointA, EndPoint=llx_5.PointA)
preview_7 = CustomPreview(Geometry=ln_13, Material=ColourSwatch(SwatchColor=RGB(255, 0, 0)))

null_8 = NullItem(Item=llx_2.PointA)  # -> NullFlags, InvalidFlags, Description
not_8 = GateNot(A=null_8.NullFlags)
cull_8 = CullPattern(List=prune_3, CullPattern=not_8)
item_11 = ListItem(List=geo, Index=cull_8, Wrap=True)
Z_6 = UnitZ(Factor=1)
vec_8 = Vector(item_11)
vrot_6 = Rotate(Vector=vec_8, Axis=Z_6, Angle=-1.570796327)  # -> graft(Vector)
line_5 = LineSDL(Start=divdist_2.Points, Direction=vrot_6, Length=1)
llx_6 = LineLine(Line1=line_5, Line2=graft(item_11))  # -> ParamA, ParamB, PointA, PointB
ln_14 = Line(StartPoint=divdist_2.Points, EndPoint=llx_6.PointA)
preview_8 = CustomPreview(Geometry=ln_14, Material=ColourSwatch(SwatchColor=RGB(255, 0, 0)))

item_12 = ListItem(List=cull_i_3, Index=-1, Wrap=True)
item_13 = ListItem(List=cull_i_3, Index=0, Wrap=True)
divdist_3 = DivideDistance(Curve=[item_13, item_12], Distance=spacing)  # -> Points, Tangents, Parameters
mindex_4 = MemberIndex(Set=int, Member=-1)  # -> Index, Count
Z_7 = UnitZ(Factor=1)
subtraction_2 = Subtraction(A=mindex_4.Index, B=1)
addition = Addition(A=mindex_4.Index, B=1)
item_14 = ListItem(List=geo, Index=[subtraction_2, addition], Wrap=True)
vec_9 = Vector(item_14)
vrot_7 = Rotate(Vector=vec_9, Axis=Z_7, Angle=1.570796327)
line_6 = LineSDL(Start=divdist_3.Points, Direction=graft(vrot_7), Length=1)
llx_7 = LineLine(Line1=line_6, Line2=graft(item_14))  # -> ParamA, ParamB, PointA, PointB
ln_15 = Line(StartPoint=llx_7.PointA, EndPoint=divdist_3.Points)

cull_i_6 = CullIndex(List=ln_15, Indices=0, Wrap=True)
flip_2 = FlipCurve(Curve=cull_i_6)  # -> Curve, Flag
negative = Relay([ln_14, ln_13, flip.Curve, flip_2.Curve])
clean_2 = CleanTree(RemoveNulls=True, RemoveInvalid=True, RemoveEmpty=False, Tree=flatten(negative))
flip_3 = FlipCurve(Curve=clean_2)  # -> Curve, Flag
dash = DashPattern(Curve=flip_3.Curve, Pattern=[Slider(0.5, range=0..1), Slider(0.25, range=0..1)])  # -> Dashes, Gaps
c_script_7 = CSharpScript(geom=dash.Dashes, key="myName", value="negative")  # -> out, A; inputs geom: list of Curve, key: String, value: String; same code as c_script

# ---- group: RH_OUT:negative
crv_7 = Curve(c_script_7.A)

# ----
preview_9 = CustomPreview(Geometry=flip_2.Curve, Material=ColourSwatch(SwatchColor=RGB(255, 178, 0)))

bang_4 = ExplodeTree(Data=divdist_3.Points)  # -> Branch0, Branch1
ln_16 = Line(StartPoint=bang_4.Branch0, EndPoint=bang_4.Branch1)

cull_i_7 = CullIndex(List=ln_16, Indices=0, Wrap=True)
positive = Relay([cull_i_5, cull_i_7, ln_12])
clean_3 = CleanTree(RemoveNulls=True, RemoveInvalid=True, RemoveEmpty=False, Tree=flatten(positive))
c_script_8 = CSharpScript(geom=clean_3, key="myName", value="positive")  # -> out, A; inputs geom: list of Curve, key: String, value: String; same code as c_script

# ---- group: RH_OUT:positive
crv_8 = Curve(c_script_8.A)

# ----
preview_10 = CustomPreview(Geometry=cull_i_7, Material=ColourSwatch(SwatchColor=RGB(153, 255, 0)))
