# Grasshopper definition RozvanyDraw.gh (Grasshopper 1.0.7)
# plug-ins: Kangaroo2 Components

pipeline = GeometryPipeline(
    GroupByLayer=False,
    GroupByType=False,
    IncludeHidden=True,
    IncludeLocked=True,
    LayerFilter="Clamped boundary",
    NameFilter="*",
    SublayerFiltering=False,
    TypeFilter=4)
pipeline_2 = GeometryPipeline(
    GroupByLayer=False,
    GroupByType=False,
    IncludeHidden=True,
    IncludeLocked=True,
    LayerFilter="Clamped interior",
    NameFilter="*",
    SublayerFiltering=False,
    TypeFilter=1)
pipeline_3 = GeometryPipeline(
    GroupByLayer=False,
    GroupByType=False,
    IncludeHidden=True,
    IncludeLocked=True,
    LayerFilter="Clamped interior",
    NameFilter="*",
    SublayerFiltering=False,
    TypeFilter=4)

boundarypoints = GetPoint(AtLeast=3, AtMost=2147483647, Realtime=True)
arcpoints = GetPoint(AtLeast=0, AtMost=3, Realtime=True)  # disabled
lnpoints = GetPoint(AtLeast=1, AtMost=2147483647, Realtime=True)
geo = Geometry([<point referenced from the Rhino model> x2])
item = ListItem(List=arcpoints, Index=0, Wrap=True)  # -> Item, Item1, Item2
pline = PolyLine(Vertices=flatten(lnpoints), Closed=False)  # -> simplify(Polyline)
pline_2 = PolyLine(Vertices=flatten(boundarypoints), Closed=invert(False))
arc = Arc3Pt(PointA=item.Item, PointB=item.Item1, PointC=item.Item2)  # -> simplify(Arc), Plane, Radius
len = Length(Curve=pline)

pipeline_4 = GeometryPipeline(
    GroupByLayer=False,
    GroupByType=False,
    IncludeHidden=True,
    IncludeLocked=True,
    LayerFilter="Clamped boundary",
    NameFilter="*",
    SublayerFiltering=False,
    TypeFilter=4)  # disabled
pipeline_5 = GeometryPipeline(
    GroupByLayer=False,
    GroupByType=False,
    IncludeHidden=True,
    IncludeLocked=True,
    LayerFilter="Clamped interior",
    NameFilter="*",
    SublayerFiltering=False,
    TypeFilter=1)  # disabled
pipeline_6 = GeometryPipeline(
    GroupByLayer=False,
    GroupByType=False,
    IncludeHidden=True,
    IncludeLocked=True,
    LayerFilter="Clamped interior",
    NameFilter="*",
    SublayerFiltering=False,
    TypeFilter=4)  # disabled

geo_2 = Geometry([<point referenced from the Rhino model> x2])  # disabled
pline_3 = PolyLine(Vertices=geo_2, Closed=False)  # -> simplify(Polyline); disabled
colpoints = GetPoint(AtLeast=0, AtMost=2147483647, Realtime=True)

len_2 = Length(Curve=pipeline_6)  # disabled
number_slider = Slider(2, range=1..20)  # disabled
division = Division(A=len_2, B=number_slider)  # disabled
round = Round(Number=division)  # -> Nearest, Floor, Ceiling; disabled
divide = DivideCurve(Curve=simplify(graft(pipeline_6)), Count=simplify(graft(round.Nearest)), Kinks=False)  # -> Points, Tangents, Parameters; disabled
pline_4 = PolyLine(Vertices=divide.Points, Closed=False)  # disabled
pt = Point(divide.Points)  # disabled

explode = Explode(Curve=pipeline_4, Recursive=True)  # -> Segments, Vertices; disabled
len_3 = Length(Curve=explode.Segments)  # disabled
division_2 = Division(A=len_3, B=number_slider)  # disabled
round_2 = Round(Number=division_2)  # -> Nearest, Floor, Ceiling; disabled
divide_2 = DivideCurve(Curve=explode.Segments, Count=round_2.Nearest, Kinks=False)  # -> Points, Tangents, Parameters; disabled
pline_5 = PolyLine(Vertices=divide_2.Points, Closed=False)  # disabled
end = EndPoints(Curve=graft(pline_5))  # -> Start, End; disabled
crv = Curve(pline_5)  # disabled
merge = Merge(Data1=end.Start, Data2=end.End)  # disabled
pt_2 = Point(merge)  # disabled
pt_3 = Point(divide_2.Points)  # disabled

len_4 = Length(Curve=pline_3)  # disabled
pt_4 = Point(colpoints)
division_3 = Division(A=len_4, B=number_slider)  # disabled
round_3 = Round(Number=division_3)  # -> Nearest, Floor, Ceiling; disabled
divide_3 = DivideCurve(Curve=simplify(graft(pline_3)), Count=simplify(graft(round_3.Nearest)), Kinks=False)  # -> Points, Tangents, Parameters; disabled
pt_5 = Point(divide_3.Points)  # disabled
pt_6 = Point(pipeline_5)  # disabled
merge_2 = Merge(Data1=pt_5, Data2=pt)  # disabled
panel = Panel("""1
2""")
int = Integer(panel)
neg = Negative(Value=Slider(2, range=0..10))
number_slider_2 = Slider(0.5, range=0..1)
panel_2 = Panel("""1
2""")  # disabled
number_slider_3 = Slider(2, range=0..10)  # disabled
int_2 = Integer(panel_2)  # disabled
neg_2 = Negative(Value=number_slider_3)  # disabled
number_slider_4 = Slider(0.5, range=0..1)  # disabled
number_slider_5 = Slider(10, range=0..16)
number_slider_6 = Slider(5, range=0..16)
multiplication = Multiplication(A=number_slider_5, B=2)  # disabled
multiplication_2 = Multiplication(A=number_slider_6, B=2)  # disabled
panel_3 = Panel("0")  # disabled
panel_4 = Panel("test")  # disabled
panel_5 = Panel("myName")  # disabled
explode_2 = Explode(Curve=pline, Recursive=True)  # -> Segments, Vertices
c_script = CSharpScript(geom=explode_2.Segments, key=panel_5, value=panel_4)  # -> out, A; inputs geom: list of Curve, key: String, value: String; disabled
# ---------- c_script: C# usings ----------
using System.IO;
using System.Linq;
using System.Data;
using System.Drawing;
using System.Reflection;
using System.Windows.Forms;
using System.Xml;
using System.Xml.Linq;
using System.Runtime.InteropServices;

using Rhino.DocObjects;
using Rhino.Collections;
using GH_IO;
using GH_IO.Serialization;
# ---------- c_script: C# ----------
    for (int i = 0; i < geom.Count; i++){
      geom[i].SetUserString(_key, _value);
      A = geom;
    }
# ---------- end c_script ----------

# ---- group: RH_OUT:test
geo_3 = Geometry(explode_2.Segments)

# ----
number_slider_7 = Slider(0.25, range=0..1)  # disabled
number_slider_8 = Slider(1, range=0..1)  # disabled

explode_3 = Explode(Curve=pline_2, Recursive=True)  # -> Segments, Vertices
len_5 = Length(Curve=explode_3.Segments)

len_6 = Length(Curve=arc.Arc)
number_slider_9 = Slider(10, range=10..20)

spacing = GetNumber(number_slider_9, AtLeast=1, AtMost=2147483647, Maximum=1.797693135e+308, Minimum=-1.797693135e+308)

division_4 = Division(A=len_6, B=spacing)
round_4 = Round(Number=division_4)  # -> Nearest, Floor, Ceiling
divide_4 = DivideCurve(Curve=simplify(graft(arc.Arc)), Count=simplify(graft(round_4.Nearest)), Kinks=False)  # -> Points, Tangents, Parameters
pline_6 = PolyLine(Vertices=divide_4.Points, Closed=False)
pt_7 = Point(divide_4.Points)

division_5 = Division(A=len_5, B=spacing)
round_5 = Round(Number=division_5)  # -> Nearest, Floor, Ceiling
divide_5 = DivideCurve(Curve=explode_3.Segments, Count=round_5.Nearest, Kinks=False)  # -> Points, Tangents, Parameters
pline_7 = PolyLine(Vertices=divide_5.Points, Closed=False)
pt_8 = Point(divide_5.Points)

division_6 = Division(A=len, B=spacing)
round_6 = Round(Number=division_6)  # -> Nearest, Floor, Ceiling
divide_6 = DivideCurve(Curve=simplify(graft(pline)), Count=simplify(graft(round_6.Nearest)), Kinks=False)  # -> Points, Tangents, Parameters
pline_8 = PolyLine(Vertices=divide_6.Points, Closed=False)
pt_9 = Point(divide_6.Points)
merge_3 = Merge(Data1=pt_9, Data2=pt_7)

entwine = Entwine(Branch0X=simplify(divide_6.Points), Branch1X=simplify(graft(pt_4)), Branch2X=simplify(pt_8), FlattenInputs=False)

pt_10 = Point(entwine)

voronoi = Voronoi(Points=flatten(pt_10), BruteForceOverride=False)

unflatten = UnflattenTree(Tree=voronoi, Guide=pt_10)
runion = RegionUnion(Curves=unflatten)
trim = TrimWithRegion(Curve=runion, Region=pline_2)  # -> Inside, Outside
merge_4 = Merge(Data1=trim.Inside, Data2=pline_2)

entwine_2 = Entwine(Branch0X=simplify(merge_2), Branch1X=simplify(graft(pt_6)), Branch2X=simplify(pt_3), FlattenInputs=False)  # disabled

pt_11 = Point(entwine_2)  # disabled

voronoi_2 = Voronoi(Points=flatten(pt_11), BruteForceOverride=False)  # disabled

unflatten_2 = UnflattenTree(Tree=voronoi_2, Guide=pt_11)  # disabled
runion_2 = RegionUnion(Curves=unflatten_2)  # disabled
trim_2 = TrimWithRegion(Curve=runion_2, Region=pipeline_4)  # -> Inside, Outside; disabled
merge_5 = Merge(Data1=trim_2.Inside, Data2=pipeline_4)  # disabled

crv_2 = Curve(merge_4)
explode_4 = Explode(Curve=flatten(crv_2), Recursive=True)  # -> Segments, Vertices
dupln = RemoveDuplicateLines(Lines=flatten(explode_4.Segments), Tolerance=Slider(0.005, range=0..0.01))
join = JoinCurves(Curves=dupln, Preserve=False)
mcx = MultipleCurves(Curves=join)  # -> Points, IndexA, IndexB, ParamA, ParamB
Z = UnitZ(Factor=1)
line = LineSDL(Start=mcx.Points, Direction=Z, Length=1)
ccx = CurveCurve(CurveA=graft(crv_2), CurveB=line)  # -> Points, ParamsA, ParamsB
pshift = ShiftPaths(Data=simplify(ccx.ParamsA), Offset=-1)
shatter = Shatter(Curve=graft(crv_2), Parameters=pshift)
eval = EvaluateLength(Curve=flatten(shatter), Length=Slider(0.5, range=0..1), Normalized=True)  # -> Point, Tangent, Parameter

cullpt = CullDuplicates(Points=eval.Point, Tolerance=Slider(0.05, range=0..1), CullMode=1)  # -> Points, Indices, Valence

crv_3 = Curve(merge_5)  # disabled
number_slider_10 = Slider(0.005, range=0..0.01)  # disabled
explode_5 = Explode(Curve=flatten(crv_3), Recursive=True)  # -> Segments, Vertices; disabled
dupln_2 = RemoveDuplicateLines(Lines=flatten(explode_5.Segments), Tolerance=number_slider_10)  # disabled
join_2 = JoinCurves(Curves=dupln_2, Preserve=False)  # disabled
mcx_2 = MultipleCurves(Curves=join_2)  # -> Points, IndexA, IndexB, ParamA, ParamB; disabled
Z_2 = UnitZ(Factor=1)  # disabled
line_2 = LineSDL(Start=mcx_2.Points, Direction=Z_2, Length=1)  # disabled
ccx_2 = CurveCurve(CurveA=graft(crv_3), CurveB=line_2)  # -> Points, ParamsA, ParamsB; disabled
pshift_2 = ShiftPaths(Data=simplify(ccx_2.ParamsA), Offset=-1)  # disabled
number_slider_11 = Slider(0.5, range=0..1)  # disabled
number_slider_12 = Slider(0.05, range=0..1)  # disabled
shatter_2 = Shatter(Curve=graft(crv_3), Parameters=pshift_2)  # disabled
eval_2 = EvaluateLength(Curve=flatten(shatter_2), Length=number_slider_11, Normalized=True)  # -> Point, Tangent, Parameter; disabled
number_slider_13 = Slider(0.5, range=0..1)  # disabled

cullpt_2 = CullDuplicates(Points=eval_2.Point, Tolerance=0.1, CullMode=1)  # -> Points, Indices, Valence; disabled

cull_i = CullIndex(List=flatten(shatter), Indices=cullpt.Indices, Wrap=False)
eval_3 = EvaluateLength(Curve=flatten(cull_i), Length=Slider(0.5, range=0..1), Normalized=True)  # -> Point, Tangent, Parameter

merge_6 = Merge(Data1=cull_i, Data2=pline_6, Data3=pline_8, Data4=pline_2)  # -> flatten(Result)

len_7 = Length(Curve=merge_6)
division_7 = Division(A=len_7, B=spacing)
round_7 = Round(Number=division_7)  # -> Nearest, Floor, Ceiling
divide_7 = DivideCurve(Curve=merge_6, Count=round_7.Nearest, Kinks=False)  # -> Points, Tangents, Parameters

merge_7 = Merge(Data1=divide_7.Points, Data2=pt_4)
cullpt_3 = CullDuplicates(Points=flatten(merge_7), Tolerance=0.1, CullMode=3)  # -> Points, Indices, Valence
voronoi_3 = Voronoi(Points=flatten(cullpt_3.Points), BruteForceOverride=False)

incurve = PointInCurve(Point=graft(pt_4), Curve=voronoi_3)  # -> Relationship, Point
trim_3 = TrimWithRegion(Curve=voronoi_3, Region=pline_2)  # -> Inside, Outside
mindex = MemberIndex(Set=incurve.Relationship, Member=2)  # -> Index, Count
clean = CleanTree(RemoveNulls=True, RemoveInvalid=True, RemoveEmpty=False, Tree=trim_3.Inside)
item_2 = ListItem(List=voronoi_3, Index=mindex.Index, Wrap=True)
entwine_3 = Entwine(Branch0X=simplify(divide_7.Points), Branch1X=simplify(graft(pt_4)), FlattenInputs=False)
crv_4 = Curve(clean)
len_8 = Length(Curve=item_2)
division_8 = Division(A=len_8, B=number_slider_9)
incurve_2 = PointInCurve(Point=graft(entwine_3), Curve=voronoi_3)  # -> Relationship, Point
round_8 = Round(Number=division_8)  # -> Nearest, Floor, Ceiling
divide_8 = DivideCurve(Curve=item_2, Count=round_8.Nearest, Kinks=False)  # -> Points, Tangents, Parameters
mindex_2 = MemberIndex(Set=incurve_2.Relationship, Member=int)  # -> Index, Count
ln = Line(StartPoint=graft(pt_4), EndPoint=divide_8.Points)
item_3 = ListItem(List=voronoi_3, Index=mindex_2.Index, Wrap=True)
pshift_3 = ShiftPaths(Data=simplify(item_3), Offset=neg)
runion_3 = RegionUnion(Curves=pshift_3)  # -> flatten(Result)
explode_6 = Explode(Curve=runion_3, Recursive=True)  # -> flatten(Segments), Vertices
explode_7 = Explode(Curve=pshift_3, Recursive=True)  # -> flatten(Segments), Vertices
dupln_3 = RemoveDuplicateLines(Lines=explode_6.Segments, Tolerance=0.01)
dupln_4 = RemoveDuplicateLines(Lines=explode_7.Segments, Tolerance=0.01)
eval_4 = EvaluateLength(Curve=dupln_4, Length=number_slider_2, Normalized=True)  # -> Point, Tangent, Parameter
eval_5 = EvaluateLength(Curve=dupln_3, Length=number_slider_2, Normalized=True)  # -> Point, Tangent, Parameter
difference = SetDifference(SetA=eval_4.Point, SetB=eval_5.Point)
mindex_3 = MemberIndex(Set=eval_4.Point, Member=difference)  # -> flatten(Index), Count
cset = CreateSet(List=mindex_3.Index)  # -> Set, Map
item_4 = ListItem(List=dupln_4, Index=cset.Set, Wrap=False)
trim_4 = TrimWithRegion(Curve=item_4, Region=pline_2)  # -> Inside, Outside
geo_4 = Geometry(trim_4.Outside)
lng = ListLength(List=geo_4)
larger = LargerThan(FirstNumber=lng, SecondNumber="0")  # -> LargerThan, OrEqualTo
tstat = TreeStatistics(Tree=trim_4.Inside)  # -> Paths, Length, Count
dispatch = Dispatch(List=tstat.Paths, DispatchPattern=flatten(larger.LargerThan))  # -> ListA, ListB
branch = TreeBranch(Tree=trim_4.Inside, Path=dispatch.ListA, MaintainPaths=True)
branch_2 = TreeBranch(Tree=trim_4.Inside, Path=dispatch.ListB, MaintainPaths=True)
flip = FlipCurve(Curve=ln)  # -> Curve, Flag
flip_2 = FlipCurve(Curve=branch)  # -> Curve, Flag
dash = DashPattern(Curve=flip.Curve, Pattern=[number_slider_5, number_slider_6])  # -> Dashes, Gaps
dash_2 = DashPattern(Curve=flip_2.Curve, Pattern=[number_slider_5, number_slider_6])  # -> Dashes, Gaps
cull_i_2 = CullIndex(List=dash.Dashes, Indices=[-1, -2], Wrap=True)
merge_8 = Merge(Data1=dash_2.Dashes, Data2=branch_2)

# ---- group: RH_OUT: curves
geo_5 = Geometry([merge_8, cull_i_2])

# ----
cull_i_3 = CullIndex(List=flatten(shatter_2), Indices=cullpt_2.Indices, Wrap=False)  # disabled
eval_6 = EvaluateLength(Curve=flatten(cull_i_3), Length=number_slider_13, Normalized=True)  # -> Point, Tangent, Parameter; disabled

merge_9 = Merge(Data1=cull_i_3, Data2=pline_4, Data3=pline_3)  # -> flatten(Result); disabled

len_9 = Length(Curve=merge_9)  # disabled
division_9 = Division(A=len_9, B=number_slider)  # disabled
round_9 = Round(Number=division_9)  # -> Nearest, Floor, Ceiling; disabled
divide_9 = DivideCurve(Curve=merge_9, Count=round_9.Nearest, Kinks=False)  # -> Points, Tangents, Parameters; disabled

merge_10 = Merge(Data1=simplify(divide_9.Points), Data2=simplify(pt_6))  # disabled
cullpt_4 = CullDuplicates(Points=flatten(merge_10), Tolerance=0.1, CullMode=3)  # -> Points, Indices, Valence; disabled
voronoi_4 = Voronoi(Points=flatten(cullpt_4.Points), BruteForceOverride=False)  # disabled

incurve_3 = PointInCurve(Point=graft(pt_6), Curve=voronoi_4)  # -> Relationship, Point; disabled
trim_5 = TrimWithRegion(Curve=voronoi_4, Region=pipeline_4)  # -> Inside, Outside; disabled
mindex_4 = MemberIndex(Set=incurve_3.Relationship, Member=2)  # -> Index, Count; disabled
clean_2 = CleanTree(RemoveNulls=True, RemoveInvalid=True, RemoveEmpty=False, Tree=trim_5.Inside)  # disabled
item_5 = ListItem(List=voronoi_4, Index=mindex_4.Index, Wrap=True)  # disabled
len_10 = Length(Curve=item_5)  # disabled
division_10 = Division(A=len_10, B=number_slider)  # disabled
entwine_4 = Entwine(Branch0X=simplify(divide_9.Points), Branch1X=simplify(graft(pt_6)), FlattenInputs=False)  # disabled
round_10 = Round(Number=division_10)  # -> Nearest, Floor, Ceiling; disabled
divide_10 = DivideCurve(Curve=item_5, Count=round_10.Nearest, Kinks=False)  # -> Points, Tangents, Parameters; disabled
incurve_4 = PointInCurve(Point=graft(entwine_4), Curve=voronoi_4)  # -> Relationship, Point; disabled
ln_2 = Line(StartPoint=graft(pt_6), EndPoint=divide_10.Points)  # disabled
mindex_5 = MemberIndex(Set=incurve_4.Relationship, Member=int_2)  # -> Index, Count; disabled
item_6 = ListItem(List=voronoi_4, Index=mindex_5.Index, Wrap=True)  # disabled
pshift_4 = ShiftPaths(Data=simplify(item_6), Offset=neg_2)  # disabled
runion_4 = RegionUnion(Curves=pshift_4)  # -> flatten(Result); disabled
explode_8 = Explode(Curve=runion_4, Recursive=True)  # -> flatten(Segments), Vertices; disabled
explode_9 = Explode(Curve=pshift_4, Recursive=True)  # -> flatten(Segments), Vertices; disabled
dupln_5 = RemoveDuplicateLines(Lines=explode_8.Segments, Tolerance=0.01)  # disabled
dupln_6 = RemoveDuplicateLines(Lines=explode_9.Segments, Tolerance=0.01)  # disabled
eval_7 = EvaluateLength(Curve=dupln_6, Length=number_slider_4, Normalized=True)  # -> Point, Tangent, Parameter; disabled
eval_8 = EvaluateLength(Curve=dupln_5, Length=number_slider_4, Normalized=True)  # -> Point, Tangent, Parameter; disabled
difference_2 = SetDifference(SetA=eval_7.Point, SetB=eval_8.Point)  # disabled
mindex_6 = MemberIndex(Set=eval_7.Point, Member=difference_2)  # -> flatten(Index), Count; disabled
cset_2 = CreateSet(List=mindex_6.Index)  # -> Set, Map; disabled
item_7 = ListItem(List=dupln_6, Index=cset_2.Set, Wrap=False)  # disabled
trim_6 = TrimWithRegion(Curve=item_7, Region=pipeline_4)  # -> Inside, Outside; disabled
geo_6 = Geometry(trim_6.Outside)  # disabled
lng_2 = ListLength(List=geo_6)  # disabled
geo_7 = Geometry(trim_6.Inside)  # disabled
tstat_2 = TreeStatistics(Tree=trim_6.Inside)  # -> Paths, Length, Count; disabled
larger_2 = LargerThan(FirstNumber=lng_2, SecondNumber=panel_3)  # -> LargerThan, OrEqualTo; disabled
dispatch_2 = Dispatch(List=tstat_2.Paths, DispatchPattern=flatten(larger_2.LargerThan))  # -> ListA, ListB; disabled
branch_3 = TreeBranch(Tree=trim_6.Inside, Path=dispatch_2.ListB, MaintainPaths=True)  # disabled
branch_4 = TreeBranch(Tree=trim_6.Inside, Path=dispatch_2.ListA, MaintainPaths=True)  # disabled
flip_3 = FlipCurve(Curve=branch_4)  # -> Curve, Flag; disabled
flip_4 = FlipCurve(Curve=ln_2)  # -> Curve, Flag; disabled
dash_3 = DashPattern(Curve=flip_4.Curve, Pattern=[number_slider_8, number_slider_7])  # -> Dashes, Gaps; disabled
dash_4 = DashPattern(Curve=flip_3.Curve, Pattern=[number_slider_8, number_slider_7])  # -> Dashes, Gaps; disabled
cull_i_4 = CullIndex(List=dash_3.Dashes, Indices=-1, Wrap=True)  # disabled
