# Grasshopper definition RozvanyDraw01.gh (Grasshopper 1.0.7)
# plug-ins: Kangaroo2 Components

pipeline = GeometryPipeline(
    GroupByLayer=False,
    GroupByType=False,
    IncludeHidden=True,
    IncludeLocked=True,
    LayerFilter="Clamped boundary",
    NameFilter="*",
    SublayerFiltering=False,
    TypeFilter=1)  # disabled
pipeline_2 = GeometryPipeline(
    GroupByLayer=False,
    GroupByType=False,
    IncludeHidden=True,
    IncludeLocked=True,
    LayerFilter="colPoints",
    NameFilter="*",
    SublayerFiltering=False,
    TypeFilter=1)  # disabled
pipeline_3 = GeometryPipeline(
    GroupByLayer=False,
    GroupByType=False,
    IncludeHidden=True,
    IncludeLocked=True,
    LayerFilter="Clamped interior",
    NameFilter="*",
    SublayerFiltering=False,
    TypeFilter=1)  # disabled

pipeline_4 = GeometryPipeline(
    GroupByLayer=False,
    GroupByType=False,
    IncludeHidden=True,
    IncludeLocked=True,
    LayerFilter="Clamped boundary",
    NameFilter="*",
    SublayerFiltering=False,
    TypeFilter=4)  # disabled
pipeline_5 = GeometryPipeline(
    GroupByLayer=False,
    GroupByType=False,
    IncludeHidden=True,
    IncludeLocked=True,
    LayerFilter="Clamped interior",
    NameFilter="*",
    SublayerFiltering=False,
    TypeFilter=1)  # disabled
pipeline_6 = GeometryPipeline(
    GroupByLayer=False,
    GroupByType=False,
    IncludeHidden=True,
    IncludeLocked=True,
    LayerFilter="Clamped interior",
    NameFilter="*",
    SublayerFiltering=False,
    TypeFilter=4)  # disabled

pline = PolyLine(Vertices=flatten(pipeline_3), Closed=False)  # -> simplify(Polyline); disabled
pline_2 = PolyLine(Vertices=flatten(pipeline), Closed=invert(False))  # disabled

pipeline_7 = GeometryPipeline(
    GroupByLayer=False,
    GroupByType=False,
    IncludeHidden=True,
    IncludeLocked=True,
    LayerFilter="Clamped boundary",
    NameFilter="*",
    SublayerFiltering=False,
    TypeFilter=1)
pipeline_8 = GeometryPipeline(
    GroupByLayer=False,
    GroupByType=False,
    IncludeHidden=True,
    IncludeLocked=True,
    LayerFilter="colPoints",
    NameFilter="*",
    SublayerFiltering=False,
    TypeFilter=1)
pipeline_9 = GeometryPipeline(
    GroupByLayer=False,
    GroupByType=False,
    IncludeHidden=True,
    IncludeLocked=True,
    LayerFilter="Clamped interior",
    NameFilter="*",
    SublayerFiltering=False,
    TypeFilter=1)

boundarypoints = GetPoint(AtLeast=3, AtMost=2147483647, Realtime=True)
lnpoints = GetPoint(AtLeast=1, AtMost=2147483647, Realtime=True)

number_slider = Slider(1, range=1..20)  # disabled

len = Length(Curve=pline)  # disabled
pline_3 = PolyLine(Closed=False)  # -> simplify(Polyline); disabled
pline_4 = PolyLine(Closed=invert(False))  # disabled

explode = Explode(Curve=pline_4, Recursive=True)  # -> Segments, Vertices; disabled
len_2 = Length(Curve=explode.Segments)  # disabled
division = Division(A=len_2)  # disabled
round = Round(Number=division)  # -> Nearest, Floor, Ceiling; disabled
divide = DivideCurve(Curve=explode.Segments, Count=round.Nearest, Kinks=False)  # -> Points, Tangents, Parameters; disabled
pline_5 = PolyLine(Vertices=divide.Points, Closed=False)  # disabled
pt = Point(divide.Points)  # disabled

pline_6 = PolyLine(Vertices=flatten(lnpoints), Closed=False)  # -> simplify(Polyline)
pline_7 = PolyLine(Vertices=flatten(boundarypoints), Closed=invert(False))

number_slider_2 = Slider(10, range=10..20)  # disabled

len_3 = Length(Curve=pline_3)  # disabled
division_2 = Division(A=len_3)  # disabled
explode_2 = Explode(Curve=pline_6, Recursive=True)  # -> Segments, Vertices
len_4 = Length(Curve=explode_2.Segments)
relay = Relay()

explode_3 = Explode(Curve=pline_2, Recursive=True)  # -> Segments, Vertices; disabled
len_5 = Length(Curve=explode_3.Segments)  # disabled
division_3 = Division(A=len_5, B=relay)  # disabled
round_2 = Round(Number=division_3)  # -> Nearest, Floor, Ceiling; disabled
divide_2 = DivideCurve(Curve=explode_3.Segments, Count=round_2.Nearest, Kinks=False)  # -> Points, Tangents, Parameters; disabled
pline_8 = PolyLine(Vertices=divide_2.Points, Closed=False)  # disabled
pt_2 = Point(divide_2.Points)  # disabled

division_4 = Division(A=len, B=relay)  # disabled
round_3 = Round(Number=division_4)  # -> Nearest, Floor, Ceiling; disabled
divide_3 = DivideCurve(Curve=simplify(graft(pline)), Count=simplify(graft(round_3.Nearest)), Kinks=False)  # -> Points, Tangents, Parameters; disabled
round_4 = Round(Number=division_2)  # -> Nearest, Floor, Ceiling; disabled
spacing = GetNumber(Slider(1, range=1..20), AtLeast=1, AtMost=2147483647, Maximum=1.797693135e+308, Minimum=-1.797693135e+308)

explode_4 = Explode(Curve=pline_7, Recursive=True)  # -> Segments, Vertices
len_6 = Length(Curve=explode_4.Segments)
division_5 = Division(A=len_6, B=spacing)
round_5 = Round(Number=division_5)  # -> Nearest, Floor, Ceiling
divide_4 = DivideCurve(Curve=explode_4.Segments, Count=round_5.Nearest, Kinks=False)  # -> Points, Tangents, Parameters
pline_9 = PolyLine(Vertices=divide_4.Points, Closed=False)
pt_3 = Point(divide_4.Points)

division_6 = Division(A=len_4, B=spacing)
round_6 = Round(Number=division_6)  # -> Nearest, Floor, Ceiling
divide_5 = DivideCurve(Curve=simplify(graft(pline_3)), Count=simplify(graft(round_4.Nearest)), Kinks=False)  # -> Points, Tangents, Parameters; disabled
pline_10 = PolyLine(Vertices=divide_3.Points, Closed=False)  # disabled
divide_6 = DivideCurve(Curve=simplify(graft(explode_2.Segments)), Count=simplify(graft(round_6.Nearest)), Kinks=False)  # -> Points, Tangents, Parameters
pt_4 = Point(pipeline_2)  # disabled
pline_11 = PolyLine(Vertices=divide_5.Points, Closed=False)  # disabled
colpoints = GetPoint(AtLeast=0, AtMost=2147483647, Realtime=True)
pline_12 = PolyLine(Vertices=divide_6.Points, Closed=False)
pt_5 = Point(colpoints)
pt_6 = Point()  # disabled
panel = Panel("""1
2""")  # disabled
number_slider_3 = Slider(2, range=0..10)  # disabled
int = Integer(panel)  # disabled
panel_2 = Panel("""1
2""")  # disabled
panel_3 = Panel("""1
2""")
neg = Negative(Value=number_slider_3)  # disabled
number_slider_4 = Slider(2, range=0..10)  # disabled
int_2 = Integer(panel_2)  # disabled
int_3 = Integer(panel_3)
neg_2 = Negative(Value=number_slider_4)  # disabled
neg_3 = Negative(Value=Slider(2, range=0..10))
number_slider_5 = Slider(0.5, range=0..1)  # disabled
number_slider_6 = Slider(0.5, range=0..1)  # disabled
number_slider_7 = Slider(0.5, range=0..1)
panel_4 = Panel("0")  # disabled
panel_5 = Panel("0")  # disabled
explode_5 = Explode(Curve=pline, Recursive=True)  # -> Segments, Vertices; disabled
number_slider_8 = Slider(5, range=0..16)  # disabled
number_slider_9 = Slider(10, range=0..16)  # disabled
explode_6 = Explode(Curve=explode_2.Segments, Recursive=True)  # -> Segments, Vertices
number_slider_10 = Slider(5, range=0..16)  # disabled
number_slider_11 = Slider(10, range=0..16)  # disabled
number_slider_12 = Slider(5, range=0..16)
number_slider_13 = Slider(10, range=0..16)

entwine = Entwine(Branch0X=simplify(divide_3.Points), Branch1X=simplify(graft(pt_4)), Branch2X=simplify(pt_2), FlattenInputs=False)  # disabled

pt_7 = Point(entwine)  # disabled

voronoi = Voronoi(Points=flatten(pt_7), BruteForceOverride=False)  # disabled

unflatten = UnflattenTree(Tree=voronoi, Guide=pt_7)  # disabled
runion = RegionUnion(Curves=unflatten)  # disabled
trim = TrimWithRegion(Curve=runion, Region=pline_2)  # -> Inside, Outside; disabled
merge = Merge(Data1=trim.Inside, Data2=pline_2)  # disabled

entwine_2 = Entwine(Branch0X=simplify(divide_5.Points), Branch1X=simplify(graft(pt_6)), Branch2X=simplify(pt), FlattenInputs=False)  # disabled

pt_8 = Point(entwine_2)  # disabled

voronoi_2 = Voronoi(Points=flatten(pt_8), BruteForceOverride=False)  # disabled

unflatten_2 = UnflattenTree(Tree=voronoi_2, Guide=pt_8)  # disabled
runion_2 = RegionUnion(Curves=unflatten_2)  # disabled
trim_2 = TrimWithRegion(Curve=runion_2, Region=pline_4)  # -> Inside, Outside; disabled
merge_2 = Merge(Data1=trim_2.Inside, Data2=pline_4)  # disabled

entwine_3 = Entwine(Branch0X=simplify(divide_6.Points), Branch1X=simplify(graft(pt_5)), Branch2X=simplify(pt_3), FlattenInputs=False)

pt_9 = Point(entwine_3)

voronoi_3 = Voronoi(Points=flatten(pt_9), BruteForceOverride=False)

unflatten_3 = UnflattenTree(Tree=voronoi_3, Guide=pt_9)
runion_3 = RegionUnion(Curves=unflatten_3)
trim_3 = TrimWithRegion(Curve=runion_3, Region=pline_7)  # -> Inside, Outside
merge_3 = Merge(Data1=trim_3.Inside, Data2=pline_7)

crv = Curve(merge)  # disabled
number_slider_14 = Slider(0.005, range=0..0.01)  # disabled
explode_7 = Explode(Curve=flatten(crv), Recursive=True)  # -> Segments, Vertices; disabled
dupln = RemoveDuplicateLines(Lines=flatten(explode_7.Segments), Tolerance=number_slider_14)  # disabled
join = JoinCurves(Curves=dupln, Preserve=False)  # disabled
mcx = MultipleCurves(Curves=join)  # -> Points, IndexA, IndexB, ParamA, ParamB; disabled
Z = UnitZ(Factor=1)  # disabled
line = LineSDL(Start=mcx.Points, Direction=Z, Length=1)  # disabled
ccx = CurveCurve(CurveA=graft(crv), CurveB=line)  # -> Points, ParamsA, ParamsB; disabled
pshift = ShiftPaths(Data=simplify(ccx.ParamsA), Offset=-1)  # disabled
number_slider_15 = Slider(0.5, range=0..1)  # disabled
number_slider_16 = Slider(0.05, range=0..1)  # disabled
shatter = Shatter(Curve=graft(crv), Parameters=pshift)  # disabled
eval = EvaluateLength(Curve=flatten(shatter), Length=number_slider_15, Normalized=True)  # -> Point, Tangent, Parameter; disabled
number_slider_17 = Slider(0.5, range=0..1)  # disabled

cullpt = CullDuplicates(Points=eval.Point, Tolerance=number_slider_16, CullMode=1)  # -> Points, Indices, Valence; disabled

crv_2 = Curve(merge_2)  # disabled
explode_8 = Explode(Curve=flatten(crv_2), Recursive=True)  # -> Segments, Vertices; disabled
number_slider_18 = Slider(0.005, range=0..0.01)  # disabled
dupln_2 = RemoveDuplicateLines(Lines=flatten(explode_8.Segments), Tolerance=number_slider_18)  # disabled
join_2 = JoinCurves(Curves=dupln_2, Preserve=False)  # disabled
mcx_2 = MultipleCurves(Curves=join_2)  # -> Points, IndexA, IndexB, ParamA, ParamB; disabled
Z_2 = UnitZ(Factor=1)  # disabled
line_2 = LineSDL(Start=mcx_2.Points, Direction=Z_2, Length=1)  # disabled
ccx_2 = CurveCurve(CurveA=graft(crv_2), CurveB=line_2)  # -> Points, ParamsA, ParamsB; disabled
pshift_2 = ShiftPaths(Data=simplify(ccx_2.ParamsA), Offset=-1)  # disabled
number_slider_19 = Slider(0.5, range=0..1)  # disabled
number_slider_20 = Slider(0.05, range=0..1)  # disabled
shatter_2 = Shatter(Curve=graft(crv_2), Parameters=pshift_2)  # disabled
eval_2 = EvaluateLength(Curve=flatten(shatter_2), Length=number_slider_19, Normalized=True)  # -> Point, Tangent, Parameter; disabled
number_slider_21 = Slider(0.5, range=0..1)  # disabled

cullpt_2 = CullDuplicates(Points=eval_2.Point, Tolerance=number_slider_20, CullMode=1)  # -> Points, Indices, Valence; disabled

crv_3 = Curve(merge_3)
explode_9 = Explode(Curve=flatten(crv_3), Recursive=True)  # -> Segments, Vertices
dupln_3 = RemoveDuplicateLines(Lines=flatten(explode_9.Segments), Tolerance=Slider(0.005, range=0..0.01))
join_3 = JoinCurves(Curves=dupln_3, Preserve=False)
mcx_3 = MultipleCurves(Curves=join_3)  # -> Points, IndexA, IndexB, ParamA, ParamB
Z_3 = UnitZ(Factor=1)
line_3 = LineSDL(Start=mcx_3.Points, Direction=Z_3, Length=1)
ccx_3 = CurveCurve(CurveA=graft(crv_3), CurveB=line_3)  # -> Points, ParamsA, ParamsB
pshift_3 = ShiftPaths(Data=simplify(ccx_3.ParamsA), Offset=-1)
shatter_3 = Shatter(Curve=graft(crv_3), Parameters=pshift_3)
eval_3 = EvaluateLength(Curve=flatten(shatter_3), Length=Slider(0.5, range=0..1), Normalized=True)  # -> Point, Tangent, Parameter

cullpt_3 = CullDuplicates(Points=eval_3.Point, Tolerance=Slider(0.05, range=0..1), CullMode=1)  # -> Points, Indices, Valence

cull_i = CullIndex(List=flatten(shatter), Indices=cullpt.Indices, Wrap=False)  # disabled
eval_4 = EvaluateLength(Curve=flatten(cull_i), Length=number_slider_17, Normalized=True)  # -> Point, Tangent, Parameter; disabled

merge_4 = Merge(Data1=cull_i, Data2=pline_10, Data3=pline_2)  # -> flatten(Result); disabled

len_7 = Length(Curve=merge_4)  # disabled
division_7 = Division(A=len_7, B=relay)  # disabled
round_7 = Round(Number=division_7)  # -> Nearest, Floor, Ceiling; disabled
divide_7 = DivideCurve(Curve=merge_4, Count=round_7.Nearest, Kinks=False)  # -> Points, Tangents, Parameters; disabled

merge_5 = Merge(Data1=divide_7.Points, Data2=pt_4)  # disabled
cullpt_4 = CullDuplicates(Points=flatten(merge_5), Tolerance=0.1, CullMode=3)  # -> Points, Indices, Valence; disabled
voronoi_4 = Voronoi(Points=flatten(cullpt_4.Points), BruteForceOverride=False)  # disabled

incurve = PointInCurve(Point=graft(pt_4), Curve=voronoi_4)  # -> Relationship, Point; disabled
trim_4 = TrimWithRegion(Curve=voronoi_4, Region=pline_2)  # -> Inside, Outside; disabled
mindex = MemberIndex(Set=incurve.Relationship, Member=2)  # -> Index, Count; disabled
clean = CleanTree(RemoveNulls=True, RemoveInvalid=True, RemoveEmpty=False, Tree=trim_4.Inside)  # disabled
item = ListItem(List=voronoi_4, Index=mindex.Index, Wrap=True)  # disabled
entwine_4 = Entwine(Branch0X=simplify(divide_7.Points), Branch1X=simplify(graft(pt_4)), FlattenInputs=False)  # disabled
crv_4 = Curve(clean)  # disabled
len_8 = Length(Curve=item)  # disabled
incurve_2 = PointInCurve(Point=graft(entwine_4), Curve=voronoi_4)  # -> Relationship, Point; disabled
division_8 = Division(A=len_8, B=relay)  # disabled
round_8 = Round(Number=division_8)  # -> Nearest, Floor, Ceiling; disabled
divide_8 = DivideCurve(Curve=item, Count=round_8.Nearest, Kinks=False)  # -> Points, Tangents, Parameters; disabled
mindex_2 = MemberIndex(Set=incurve_2.Relationship, Member=int)  # -> Index, Count; disabled
ln = Line(StartPoint=graft(pt_4), EndPoint=divide_8.Points)  # -> flatten(Line); disabled
item_2 = ListItem(List=voronoi_4, Index=mindex_2.Index, Wrap=True)  # disabled
pshift_4 = ShiftPaths(Data=simplify(item_2), Offset=neg)  # disabled
runion_4 = RegionUnion(Curves=pshift_4)  # -> flatten(Result); disabled
explode_10 = Explode(Curve=pshift_4, Recursive=True)  # -> flatten(Segments), Vertices; disabled
explode_11 = Explode(Curve=runion_4, Recursive=True)  # -> flatten(Segments), Vertices; disabled
dupln_4 = RemoveDuplicateLines(Lines=explode_11.Segments, Tolerance=0.01)  # disabled
dupln_5 = RemoveDuplicateLines(Lines=explode_10.Segments, Tolerance=0.01)  # disabled
eval_5 = EvaluateLength(Curve=dupln_5, Length=number_slider_5, Normalized=True)  # -> Point, Tangent, Parameter; disabled
eval_6 = EvaluateLength(Curve=dupln_4, Length=number_slider_5, Normalized=True)  # -> Point, Tangent, Parameter; disabled
difference = SetDifference(SetA=eval_5.Point, SetB=eval_6.Point)  # disabled
mindex_3 = MemberIndex(Set=eval_5.Point, Member=difference)  # -> flatten(Index), Count; disabled
cset = CreateSet(List=mindex_3.Index)  # -> Set, Map; disabled
item_3 = ListItem(List=dupln_5, Index=cset.Set, Wrap=False)  # disabled
trim_5 = TrimWithRegion(Curve=item_3, Region=pline_2)  # -> Inside, Outside; disabled
geo = Geometry(trim_5.Inside)  # disabled
geo_2 = Geometry(trim_5.Outside)  # disabled
lng = ListLength(List=geo_2)  # disabled
larger = LargerThan(FirstNumber=lng, SecondNumber=panel_4)  # -> LargerThan, OrEqualTo; disabled
tstat = TreeStatistics(Tree=trim_5.Inside)  # -> Paths, Length, Count; disabled
dispatch = Dispatch(List=tstat.Paths, DispatchPattern=flatten(larger.LargerThan))  # -> ListA, ListB; disabled
branch = TreeBranch(Tree=trim_5.Inside, Path=dispatch.ListB, MaintainPaths=True)  # -> flatten(Branch); disabled
branch_2 = TreeBranch(Tree=trim_5.Inside, Path=dispatch.ListA, MaintainPaths=True)  # disabled
colom = CollisionOneMany(Collider=branch, Obstacles=explode_5.Segments)  # -> Collision, Index; disabled
flip = FlipCurve(Curve=branch_2)  # -> flatten(Curve), Flag; disabled
dispatch_2 = Dispatch(List=flatten(branch), DispatchPattern=colom.Collision)  # -> ListA, ListB; disabled
geo_3 = Geometry(dispatch_2.ListA)  # disabled
dash = DashPattern(Curve=graft(ln), Pattern=[number_slider_9, number_slider_8])  # -> Dashes, Gaps; disabled
dash_2 = DashPattern(Curve=graft(geo_3), Pattern=[number_slider_9, number_slider_8])  # -> flatten(Dashes), Gaps; disabled
dash_3 = DashPattern(Curve=graft(flip.Curve), Pattern=[number_slider_9, number_slider_8])  # -> Dashes, Gaps; disabled
cull_i_2 = CullIndex(List=dash.Dashes, Indices=0, Wrap=True)  # disabled

# ---- group: RH_OUT: interior solid
crv_5 = Curve(dispatch_2.ListB)  # disabled

# ---- group: RH_OUT: interior dashed
crv_6 = Curve(dash_2.Dashes)  # disabled

# ---- group: RH_OUT: radial
crv_7 = Curve(cull_i_2)  # disabled

# ---- group: RH_OUT:edges
crv_8 = Curve(dash_3.Dashes)  # disabled

# ----
cull_i_3 = CullIndex(List=flatten(shatter_2), Indices=cullpt_2.Indices, Wrap=False)  # disabled
eval_7 = EvaluateLength(Curve=flatten(cull_i_3), Length=number_slider_21, Normalized=True)  # -> Point, Tangent, Parameter; disabled

merge_6 = Merge(Data1=cull_i_3, Data2=pline_11, Data3=pline_4)  # -> flatten(Result); disabled

len_9 = Length(Curve=merge_6)  # disabled
division_9 = Division(A=len_9)  # disabled
round_9 = Round(Number=division_9)  # -> Nearest, Floor, Ceiling; disabled
divide_9 = DivideCurve(Curve=merge_6, Count=round_9.Nearest, Kinks=False)  # -> Points, Tangents, Parameters; disabled

merge_7 = Merge(Data1=divide_9.Points, Data2=pt_6)  # disabled
cullpt_5 = CullDuplicates(Points=flatten(merge_7), Tolerance=0.1, CullMode=3)  # -> Points, Indices, Valence; disabled
voronoi_5 = Voronoi(Points=flatten(cullpt_5.Points), BruteForceOverride=False)  # disabled

incurve_3 = PointInCurve(Point=graft(pt_6), Curve=voronoi_5)  # -> Relationship, Point; disabled
trim_6 = TrimWithRegion(Curve=voronoi_5, Region=pline_4)  # -> Inside, Outside; disabled
mindex_4 = MemberIndex(Set=incurve_3.Relationship, Member=2)  # -> Index, Count; disabled
clean_2 = CleanTree(RemoveNulls=True, RemoveInvalid=True, RemoveEmpty=False, Tree=trim_6.Inside)  # disabled
item_4 = ListItem(List=voronoi_5, Index=mindex_4.Index, Wrap=True)  # disabled
entwine_5 = Entwine(Branch0X=simplify(divide_9.Points), Branch1X=simplify(graft(pt_6)), FlattenInputs=False)  # disabled
crv_9 = Curve(clean_2)  # disabled
len_10 = Length(Curve=item_4)  # disabled
division_10 = Division(A=len_10, B=number_slider_2)  # disabled
incurve_4 = PointInCurve(Point=graft(entwine_5), Curve=voronoi_5)  # -> Relationship, Point; disabled
round_10 = Round(Number=division_10)  # -> Nearest, Floor, Ceiling; disabled
divide_10 = DivideCurve(Curve=item_4, Count=round_10.Nearest, Kinks=False)  # -> Points, Tangents, Parameters; disabled
mindex_5 = MemberIndex(Set=incurve_4.Relationship, Member=int_2)  # -> Index, Count; disabled
ln_2 = Line(StartPoint=graft(pt_6), EndPoint=divide_10.Points)  # -> flatten(Line); disabled
item_5 = ListItem(List=voronoi_5, Index=mindex_5.Index, Wrap=True)  # disabled
pshift_5 = ShiftPaths(Data=simplify(item_5), Offset=neg_2)  # disabled
runion_5 = RegionUnion(Curves=pshift_5)  # -> flatten(Result); disabled
explode_12 = Explode(Curve=runion_5, Recursive=True)  # -> flatten(Segments), Vertices; disabled
explode_13 = Explode(Curve=pshift_5, Recursive=True)  # -> flatten(Segments), Vertices; disabled
dupln_6 = RemoveDuplicateLines(Lines=explode_12.Segments, Tolerance=0.01)  # disabled
dupln_7 = RemoveDuplicateLines(Lines=explode_13.Segments, Tolerance=0.01)  # disabled
eval_8 = EvaluateLength(Curve=dupln_7, Length=number_slider_6, Normalized=True)  # -> Point, Tangent, Parameter; disabled
eval_9 = EvaluateLength(Curve=dupln_6, Length=number_slider_6, Normalized=True)  # -> Point, Tangent, Parameter; disabled
difference_2 = SetDifference(SetA=eval_8.Point, SetB=eval_9.Point)  # disabled
mindex_6 = MemberIndex(Set=eval_8.Point, Member=difference_2)  # -> flatten(Index), Count; disabled
cset_2 = CreateSet(List=mindex_6.Index)  # -> Set, Map; disabled
item_6 = ListItem(List=dupln_7, Index=cset_2.Set, Wrap=False)  # disabled
trim_7 = TrimWithRegion(Curve=item_6, Region=pline_4)  # -> Inside, Outside; disabled
geo_4 = Geometry(trim_7.Outside)  # disabled
lng_2 = ListLength(List=geo_4)  # disabled
larger_2 = LargerThan(FirstNumber=lng_2, SecondNumber=panel_5)  # -> LargerThan, OrEqualTo; disabled
tstat_2 = TreeStatistics(Tree=trim_7.Inside)  # -> Paths, Length, Count; disabled
dispatch_3 = Dispatch(List=tstat_2.Paths, DispatchPattern=flatten(larger_2.LargerThan))  # -> ListA, ListB; disabled
branch_3 = TreeBranch(Tree=trim_7.Inside, Path=dispatch_3.ListA, MaintainPaths=True)  # disabled
branch_4 = TreeBranch(Tree=trim_7.Inside, Path=dispatch_3.ListB, MaintainPaths=True)  # disabled
colom_2 = CollisionOneMany(Collider=flatten(branch_4), Obstacles=pline_11)  # -> Collision, Index; disabled
dispatch_4 = Dispatch(List=flatten(branch_4), DispatchPattern=colom_2.Collision)  # -> flatten(ListA), ListB; disabled
flip_2 = FlipCurve(Curve=branch_3)  # -> flatten(Curve), Flag; disabled
geo_5 = Geometry(dispatch_4.ListA)  # disabled
dash_4 = DashPattern(Curve=graft(ln_2), Pattern=[number_slider_11, number_slider_10])  # -> Dashes, Gaps; disabled
dash_5 = DashPattern(Curve=graft([flip_2.Curve, geo_5]), Pattern=[number_slider_11, number_slider_10])  # -> Dashes, Gaps; disabled
cull_i_4 = CullIndex(List=dash_4.Dashes, Indices=0, Wrap=True)  # disabled
merge_8 = Merge(Data1=dash_5.Dashes, Data2=dispatch_4.ListB)  # disabled

cull_i_5 = CullIndex(List=flatten(shatter_3), Indices=cullpt_3.Indices, Wrap=False)
eval_10 = EvaluateLength(Curve=flatten(cull_i_5), Length=Slider(0.5, range=0..1), Normalized=True)  # -> Point, Tangent, Parameter

merge_9 = Merge(Data1=cull_i_5, Data2=explode_2.Segments, Data3=pline_7)  # -> flatten(Result)

len_11 = Length(Curve=merge_9)
division_11 = Division(A=len_11, B=spacing)
round_11 = Round(Number=division_11)  # -> Nearest, Floor, Ceiling
divide_11 = DivideCurve(Curve=merge_9, Count=round_11.Nearest, Kinks=False)  # -> Points, Tangents, Parameters

merge_10 = Merge(Data1=divide_11.Points, Data2=pt_5)
cullpt_6 = CullDuplicates(Points=flatten(merge_10), Tolerance=0.1, CullMode=3)  # -> Points, Indices, Valence
voronoi_6 = Voronoi(Points=flatten(cullpt_6.Points), BruteForceOverride=False)

incurve_5 = PointInCurve(Point=graft(pt_5), Curve=voronoi_6)  # -> Relationship, Point
trim_8 = TrimWithRegion(Curve=voronoi_6, Region=pline_7)  # -> Inside, Outside
mindex_7 = MemberIndex(Set=incurve_5.Relationship, Member=2)  # -> Index, Count
clean_3 = CleanTree(RemoveNulls=True, RemoveInvalid=True, RemoveEmpty=False, Tree=trim_8.Inside)
item_7 = ListItem(List=voronoi_6, Index=mindex_7.Index, Wrap=True)
entwine_6 = Entwine(Branch0X=simplify(divide_11.Points), Branch1X=simplify(graft(pt_5)), FlattenInputs=False)
crv_10 = Curve(clean_3)
len_12 = Length(Curve=item_7)
incurve_6 = PointInCurve(Point=graft(entwine_6), Curve=voronoi_6)  # -> Relationship, Point
division_12 = Division(A=len_12, B=spacing)
round_12 = Round(Number=division_12)  # -> Nearest, Floor, Ceiling
divide_12 = DivideCurve(Curve=item_7, Count=round_12.Nearest, Kinks=False)  # -> Points, Tangents, Parameters
mindex_8 = MemberIndex(Set=incurve_6.Relationship, Member=int_3)  # -> Index, Count
ln_3 = Line(StartPoint=graft(pt_5), EndPoint=divide_12.Points)  # -> flatten(Line)
item_8 = ListItem(List=voronoi_6, Index=mindex_8.Index, Wrap=True)
pshift_6 = ShiftPaths(Data=simplify(item_8), Offset=neg_3)
runion_6 = RegionUnion(Curves=pshift_6)  # -> flatten(Result)
explode_14 = Explode(Curve=pshift_6, Recursive=True)  # -> flatten(Segments), Vertices
explode_15 = Explode(Curve=runion_6, Recursive=True)  # -> flatten(Segments), Vertices
dupln_8 = RemoveDuplicateLines(Lines=explode_15.Segments, Tolerance=0.01)
dupln_9 = RemoveDuplicateLines(Lines=explode_14.Segments, Tolerance=0.01)
eval_11 = EvaluateLength(Curve=dupln_9, Length=number_slider_7, Normalized=True)  # -> Point, Tangent, Parameter
eval_12 = EvaluateLength(Curve=dupln_8, Length=number_slider_7, Normalized=True)  # -> Point, Tangent, Parameter
difference_3 = SetDifference(SetA=eval_11.Point, SetB=eval_12.Point)
mindex_9 = MemberIndex(Set=eval_11.Point, Member=difference_3)  # -> flatten(Index), Count
cset_3 = CreateSet(List=mindex_9.Index)  # -> Set, Map
item_9 = ListItem(List=dupln_9, Index=cset_3.Set, Wrap=False)
trim_9 = TrimWithRegion(Curve=item_9, Region=pline_7)  # -> Inside, Outside
geo_6 = Geometry(trim_9.Inside)
geo_7 = Geometry(trim_9.Outside)
lng_3 = ListLength(List=geo_7)
larger_3 = LargerThan(FirstNumber=lng_3, SecondNumber="0")  # -> LargerThan, OrEqualTo
tstat_3 = TreeStatistics(Tree=trim_9.Inside)  # -> Paths, Length, Count
dispatch_5 = Dispatch(List=tstat_3.Paths, DispatchPattern=flatten(larger_3.LargerThan))  # -> ListA, ListB
branch_5 = TreeBranch(Tree=trim_9.Inside, Path=dispatch_5.ListB, MaintainPaths=True)  # -> flatten(Branch)
branch_6 = TreeBranch(Tree=trim_9.Inside, Path=dispatch_5.ListA, MaintainPaths=True)
colom_3 = CollisionOneMany(Collider=branch_5, Obstacles=pline_6)  # -> Collision, Index
flip_3 = FlipCurve(Curve=branch_6)  # -> flatten(Curve), Flag
dispatch_6 = Dispatch(List=flatten(branch_5), DispatchPattern=colom_3.Collision)  # -> ListA, ListB
geo_8 = Geometry(dispatch_6.ListA)
dash_6 = DashPattern(Curve=graft(ln_3), Pattern=[number_slider_13, number_slider_12])  # -> Dashes, Gaps
dash_7 = DashPattern(Curve=graft(geo_8), Pattern=[number_slider_13, number_slider_12])  # -> flatten(Dashes), Gaps
dash_8 = DashPattern(Curve=graft(flip_3.Curve), Pattern=[number_slider_13, number_slider_12])  # -> Dashes, Gaps
cull_i_6 = CullIndex(List=dash_6.Dashes, Indices=0, Wrap=True)

# ---- group: RH_OUT: interior solid
crv_11 = Curve(dispatch_6.ListB)

# ---- group: RH_OUT: interior dashed
crv_12 = Curve(dash_7.Dashes)

# ---- group: RH_OUT: radial
crv_13 = Curve(cull_i_6)

# ---- group: RH_OUT:edges
crv_14 = Curve(dash_8.Dashes)
