# Grasshopper definition RozvanyDraw02.gh (Grasshopper 1.0.7)
# plug-ins: Kangaroo2 Components

panel = Panel("""2
4""")
splitindex = GetInteger(panel, AtLeast=0, AtMost=2147483647, Maximum=2147483647, Minimum=-2147483648)
item = ListItem(List=splitindex, Index=0, Wrap=True)
shift = ShiftList(List=splitindex, Shift=1, Wrap=True)
subtraction = Subtraction(A=shift, B=splitindex)
cull_i = CullIndex(List=subtraction, Indices="-1", Wrap=True)
merge = Merge(Data1=item, Data2=cull_i)  # -> flatten(Result)
lng = ListLength(List=merge)
rectangle = Rectangle(Plane=PlaneXY(0, 0, 0), XSize="-10 to 10", YSize="-10 to 10", Radius=0)  # -> Rectangle, Length
equals = Equality(FirstNumber=lng, SecondNumber="0")  # -> Equality, Inequality
explode = Explode(Curve=rectangle.Rectangle, Recursive=True)  # -> Segments, Vertices
boundarypoints = GetPoint(explode.Vertices, AtLeast=1, AtMost=2147483647, Realtime=True)
xy = XYPlane(Origin=Point(0, 0, 0))
xy_2 = XYPlane(Origin=Point(0, 0, 0))
xy_3 = XYPlane(Origin=Point(0, 0, 0))

pipeline = GeometryPipeline(
    GroupByLayer=False,
    GroupByType=False,
    IncludeHidden=True,
    IncludeLocked=True,
    LayerFilter="Point Support",
    NameFilter="*",
    SublayerFiltering=False,
    TypeFilter=1)  # disabled
pipeline_2 = GeometryPipeline(
    GroupByLayer=False,
    GroupByType=False,
    IncludeHidden=True,
    IncludeLocked=True,
    LayerFilter="Line Support",
    NameFilter="*",
    SublayerFiltering=False,
    TypeFilter=1)  # disabled
pipeline_3 = GeometryPipeline(
    GroupByLayer=False,
    GroupByType=False,
    IncludeHidden=True,
    IncludeLocked=True,
    LayerFilter="Boundary",
    NameFilter="*",
    SublayerFiltering=False,
    TypeFilter=1)
pt = Point(flatten(boundarypoints))
num = Number(flatten(Slider(10, range=1..20)))

colpoints = GetPoint(pipeline, AtLeast=0, AtMost=2147483647, Realtime=True)
boundtype = GetInteger(Slider(2, range=0..2), AtLeast=1, AtMost=2147483647, Maximum=2, Minimum=0)
lnpoints = GetPoint(pipeline_2, AtLeast=0, AtMost=2147483647, Realtime=True)

num_2 = Number(flatten(boundtype))
pt_2 = Point(flatten(colpoints))
pt_3 = Point(flatten(lnpoints))

lng_2 = ListLength(List=pt_3)
expression = Expression(x=equals.Equality, y=lng_2, z=merge, Expression="if(x=true, y, z)")
nullrep = ReplaceNulls(Items=expression, Replacements=lng_2)  # -> Items, Count

pline = PolyLine(Vertices=flatten(pt), Closed=invert(False))
explode_2 = Explode(Curve=pline, Recursive=True)  # -> Segments, Vertices
len = Length(Curve=explode_2.Segments)
division = Division(A=len, B=num)
round = Round(Number=division)  # -> Nearest, Floor, Ceiling
divide = DivideCurve(Curve=explode_2.Segments, Count=round.Nearest, Kinks=False)  # -> Points, Tangents, Parameters
pline_2 = PolyLine(Vertices=divide.Points, Closed=False)
pt_4 = Point(pt)
crv = Curve(pline_2)

incurve = PointInCurve(Point=pt_2, Curve=pline)  # -> Relationship, Point
equals_2 = Equality(FirstNumber=incurve.Relationship, SecondNumber=2)  # -> Equality, Inequality
cull = CullPattern(List=pt_2, CullPattern=equals_2.Equality)
pt_5 = Point(cull)

difference = SetDifference(SetA=divide.Points, SetB=pt)
pt_6 = Point(divide.Points)

num_3 = Number(nullrep.Items)
partition = PartitionList(List=pt_3, Size=num_3)
pline_3 = PolyLine(Vertices=partition, Closed=False)  # -> simplify(Polyline)
explode_3 = Explode(Curve=pline_3, Recursive=True)  # -> Segments, Vertices
end = EndPoints(Curve=explode_3.Segments)  # -> Start, End
merge_2 = Merge(Data1=end.Start, Data2=end.End)
len_2 = Length(Curve=explode_3.Segments)
division_2 = Division(A=len_2, B=num)
round_2 = Round(Number=division_2)  # -> Nearest, Floor, Ceiling
divide_2 = DivideCurve(Curve=simplify(explode_3.Segments), Count=simplify(round_2.Nearest), Kinks=False)  # -> Points, Tangents, Parameters
incurve_2 = PointInCurve(Point=divide_2.Points, Curve=pline)  # -> Relationship, Point
equals_3 = Equality(FirstNumber=incurve_2.Relationship, SecondNumber=2)  # -> Equality, Inequality
cull_2 = CullPattern(List=divide_2.Points, CullPattern=equals_3.Equality)
crv_2 = Curve(explode_3.Segments)
pt_7 = Point(pt_3)

cullpt = CullDuplicates(Points=cull_2, Tolerance=0.1, CullMode=3)  # -> Points, Indices, Valence
filter = StreamFilter(Gate=num_2, Stream2=pt_4)
filter_2 = StreamFilter(Gate=num_2, Stream2=pt_6)

difference_2 = SetDifference(SetA=cullpt.Points, SetB=pt_3)
pt_8 = Point(difference_2)

merge_3 = Merge(Data1=pt_7, Data2=pt_5)  # -> flatten(Result)
filter_3 = StreamFilter(Gate=num_2, Stream1=pt_4, Stream2=pt_4)
filter_4 = StreamFilter(Gate=num_2, Stream2=pline)
filter_5 = StreamFilter(Gate=num_2, Stream1=pt_6, Stream2=pt_6)
merge_4 = Merge(Data1=filter, Data2=merge_3)
entwine = Entwine(Branch0X=simplify(graft(merge_4)), Branch1X=simplify(pt_8), Branch2X=simplify(filter_5), FlattenInputs=False)

pt_9 = Point(entwine)
voronoi = Voronoi(Points=flatten(pt_9), Plane=xy, BruteForceOverride=False)

unflatten = UnflattenTree(Tree=voronoi, Guide=pt_9)
merge_5 = Merge(Data1=unflatten, Data2=unflatten)
runion = RegionUnion(Curves=merge_5)
trim = TrimWithRegion(Curve=runion, Region=pline)  # -> Inside, Outside
crv_3 = Curve(flatten(trim.Inside))
explode_4 = Explode(Curve=flatten(crv_3), Recursive=True)  # -> Segments, Vertices
dupln = RemoveDuplicateLines(Lines=flatten(explode_4.Segments), Tolerance=0.01)
colom = CollisionOneMany(Collider=dupln, Obstacles=flatten(crv_2))  # -> Collision, Index
not = GateNot(A=colom.Collision)
Z = UnitZ(Factor=1)
len_3 = Length(Curve=crv_2)
division_3 = Division(A=len_3, B=num)
round_3 = Round(Number=division_3)  # -> Nearest, Floor, Ceiling
divide_3 = DivideCurve(Curve=crv_2, Count=round_3.Nearest, Kinks=False)  # -> Points, Tangents, Parameters
pt_10 = Point(divide_3.Points)
pt_11 = Point(pt_7)
difference_3 = SetDifference(SetA=divide_3.Points, SetB=pt_11)
pt_12 = Point(filter_2)

null = NullItem(Item=not)  # -> NullFlags, InvalidFlags, Description
lng_3 = ListLength(List=dupln)
repeat = RepeatData(Data="true", Length=lng_3)
expression_2 = Expression(x=null.NullFlags, y=repeat, z=not, Expression="if(x = true, y, z)")

cull_3 = CullPattern(List=dupln, CullPattern=expression_2)
join = JoinCurves(Curves=cull_3, Preserve=False)
end_2 = EndPoints(Curve=join)  # -> Start, End
cullpt_2 = CullDuplicates(Points=[end_2.Start, end_2.End], Tolerance=0.1, CullMode=3)  # -> Points, Indices, Valence
line = LineSDL(Start=cullpt_2.Points, Direction=Z, Length=1)
ccx = CurveCurve(CurveA=graft(join), CurveB=line)  # -> Points, ParamsA, ParamsB
pshift = ShiftPaths(Data=simplify(ccx.ParamsA), Offset=-1)
shatter = Shatter(Curve=graft(join), Parameters=pshift)  # -> flatten(Segments)
incurve_3 = PointInCurve(Point=cullpt_2.Points, Curve=pline)  # -> Relationship, Point
equals_4 = Equality(FirstNumber=incurve_3.Relationship, SecondNumber=1)  # -> Equality, Inequality
cull_4 = CullPattern(List=cullpt_2.Points, CullPattern=equals_4.Inequality)
pt_13 = Point(cull_4)

crv_4 = Curve(shatter)

len_4 = Length(Curve=crv_4)
division_4 = Division(A=len_4, B=num)
round_4 = Round(Number=division_4)  # -> Nearest, Floor, Ceiling
divide_4 = DivideCurve(Curve=crv_4, Count=round_4.Nearest, Kinks=False)  # -> Points, Tangents, Parameters
pt_14 = Point(divide_4.Points)
difference_4 = SetDifference(SetA=pt_14, SetB=pt_13)
entwine_2 = Entwine(
    Branch0X=simplify(merge_4),
    Branch1X=simplify(pt_13),
    Branch2X=simplify(difference_3),
    Branch3X=simplify(difference_4),
    Branch4X=simplify(pt_12),
    FlattenInputs=False)

pt_15 = Point(entwine_2)
voronoi_2 = Voronoi(Points=flatten(pt_15), BruteForceOverride=False)
trim_2 = TrimWithRegion(Curve=voronoi_2, Region=pline)  # -> Inside, Outside
clean = CleanTree(RemoveNulls=True, RemoveInvalid=True, RemoveEmpty=False, Tree=trim_2.Inside)

unflatten_2 = UnflattenTree(Tree=voronoi_2, Guide=pt_15)
tstat = TreeStatistics(Tree=unflatten_2)  # -> Paths, Length, Count
dpath = DeconstructPath(Branch=tstat.Paths)
item_2 = ListItem(List=dpath, Index=0, Wrap=True)
equals_5 = Equality(FirstNumber=item_2, SecondNumber=Slider(0, range=0..100))  # -> Equality, Inequality
equals_6 = Equality(FirstNumber=item_2, SecondNumber=Slider(1, range=0..100))  # -> Equality, Inequality
equals_7 = Equality(FirstNumber=item_2, SecondNumber=Slider(2, range=0..100))  # -> Equality, Inequality
equals_8 = Equality(FirstNumber=item_2, SecondNumber=Slider(3, range=0..100))  # -> Equality, Inequality
equals_9 = Equality(FirstNumber=item_2, SecondNumber=Slider(4, range=0..100))  # -> Equality, Inequality
cull_5 = CullPattern(List=graft(tstat.Paths), CullPattern=equals_5.Equality)
cull_6 = CullPattern(List=graft(tstat.Paths), CullPattern=equals_6.Equality)
cull_7 = CullPattern(List=graft(tstat.Paths), CullPattern=equals_7.Equality)
cull_8 = CullPattern(List=graft(tstat.Paths), CullPattern=equals_8.Equality)
cull_9 = CullPattern(List=graft(tstat.Paths), CullPattern=equals_9.Equality)
branch = TreeBranch(Tree=unflatten_2, Path=cull_5, MaintainPaths=True)
branch_2 = TreeBranch(Tree=unflatten_2, Path=cull_6, MaintainPaths=True)
branch_3 = TreeBranch(Tree=unflatten_2, Path=cull_7, MaintainPaths=True)
branch_4 = TreeBranch(Tree=unflatten_2, Path=cull_8, MaintainPaths=True)
branch_5 = TreeBranch(Tree=unflatten_2, Path=cull_9, MaintainPaths=True)
crv_5 = Curve(branch)
trim_3 = TrimWithRegion(Curve=branch_4, Region=pline)  # -> Inside, Outside
trim_4 = TrimWithRegion(Curve=branch_3, Region=pline)  # -> Inside, Outside
trim_5 = TrimWithRegion(Curve=branch_5, Region=pline)  # -> Inside, Outside
trim_6 = TrimWithRegion(Curve=crv_5, Region=pline)  # -> Inside, Outside
ccx_2 = CurveCurve(CurveA=pline, CurveB=trim_4.Inside)  # -> Points, ParamsA, ParamsB
ccx_3 = CurveCurve(CurveA=pline, CurveB=trim_3.Inside)  # -> Points, ParamsA, ParamsB
explode_5 = Explode(Curve=trim_5.Inside, Recursive=True)  # -> Segments, Vertices
crv_6 = Curve(trim_6.Inside)
crv_cp = CurveClosestPoint(Point=flatten(ccx_3.Points), Curve=pline)  # -> Point, Parameter, Distance
crv_cp_2 = CurveClosestPoint(Point=flatten(ccx_2.Points), Curve=pline)  # -> Point, Parameter, Distance
colom_2 = CollisionOneMany(Collider=explode_5.Segments, Obstacles=filter_4)  # -> Collision, Index
explode_6 = Explode(Curve=crv_6, Recursive=True)  # -> Segments, Vertices
explode_7 = Explode(Curve=crv_5, Recursive=True)  # -> Segments, Vertices
cull_10 = CullPattern(List=explode_5.Segments, CullPattern=colom_2.Collision)
shatter_2 = Shatter(Curve=pline, Parameters=crv_cp.Parameter)
shatter_3 = Shatter(Curve=pline, Parameters=crv_cp_2.Parameter)
pline_4 = PolyLine(Vertices=explode_7.Vertices, Closed=invert(False))
eval = EvaluateLength(Curve=shatter_3, Length=Slider(0.5, range=0..1), Normalized=True)  # -> Point, Tangent, Parameter
eval_2 = EvaluateLength(Curve=shatter_2, Length=Slider(0.5, range=0..1), Normalized=True)  # -> Point, Tangent, Parameter
incurve_4 = PointInCurve(Point=pt_4, Curve=graft(pline_4))  # -> Relationship, Point
explode_8 = Explode(Curve=branch_3, Recursive=True)  # -> Segments, Vertices
explode_9 = Explode(Curve=branch_4, Recursive=True)  # -> Segments, Vertices
mindex = MemberIndex(Set=incurve_4.Relationship, Member=2)  # -> Index, Count
pline_5 = PolyLine(Vertices=explode_8.Vertices, Closed=invert(False))
pline_6 = PolyLine(Vertices=explode_9.Vertices, Closed=invert(False))
item_3 = ListItem(List=pt_4, Index=mindex.Index, Wrap=True)
incurve_5 = PointInCurve(Point=eval.Point, Curve=graft(pline_5))  # -> Relationship, Point
incurve_6 = PointInCurve(Point=eval_2.Point, Curve=graft(pline_6))  # -> Relationship, Point
merge_6 = Merge(Data1=simplify(explode_6.Vertices), Data2=simplify(item_3))
mindex_2 = MemberIndex(Set=incurve_5.Relationship, Member=2)  # -> Index, Count
mindex_3 = MemberIndex(Set=incurve_6.Relationship, Member=2)  # -> Index, Count
pline_7 = PolyLine(Vertices=merge_6, Closed=invert(False))
panel_2 = Panel("""0.25
0.5
0.75""")
item_4 = ListItem(List=shatter_2, Index=mindex_3.Index, Wrap=True)
item_5 = ListItem(List=shatter_3, Index=mindex_2.Index, Wrap=True)
scale = Scale(Geometry=pline_7, Center=graft(merge_4), Factor=panel_2)  # -> Geometry, Transform
merge_7 = Merge(Data1=simplify(trim_3.Inside), Data2=simplify(item_4))
merge_8 = Merge(Data1=simplify(trim_4.Inside), Data2=simplify(item_5))
join_2 = JoinCurves(Curves=merge_7, Preserve=False)
join_3 = JoinCurves(Curves=merge_8, Preserve=False)
pshift_2 = ShiftPaths(Data=join_2, Offset=-2)
runion_2 = RegionUnion(Curves=pshift_2, Plane=xy_2)
pshift_3 = ShiftPaths(Data=join_3, Offset=-2)
runion_3 = RegionUnion(Curves=pshift_3, Plane=xy_3)
explode_10 = Explode(Curve=pshift_2, Recursive=True)  # -> flatten(Segments), Vertices
explode_11 = Explode(Curve=runion_2, Recursive=True)  # -> flatten(Segments), Vertices
number_slider = Slider(0.5, range=0..1)
explode_12 = Explode(Curve=pshift_3, Recursive=True)  # -> flatten(Segments), Vertices
explode_13 = Explode(Curve=runion_3, Recursive=True)  # -> flatten(Segments), Vertices
number_slider_2 = Slider(0.5, range=0..1)
dupln_2 = RemoveDuplicateLines(Lines=explode_10.Segments, Tolerance=0.01)
dupln_3 = RemoveDuplicateLines(Lines=explode_11.Segments, Tolerance=0.01)
dupln_4 = RemoveDuplicateLines(Lines=explode_13.Segments, Tolerance=0.01)
dupln_5 = RemoveDuplicateLines(Lines=explode_12.Segments, Tolerance=0.01)
eval_3 = EvaluateLength(Curve=dupln_2, Length=number_slider, Normalized=True)  # -> Point, Tangent, Parameter
eval_4 = EvaluateLength(Curve=dupln_3, Length=number_slider, Normalized=True)  # -> Point, Tangent, Parameter
eval_5 = EvaluateLength(Curve=dupln_5, Length=number_slider_2, Normalized=True)  # -> Point, Tangent, Parameter
eval_6 = EvaluateLength(Curve=dupln_4, Length=number_slider_2, Normalized=True)  # -> Point, Tangent, Parameter
difference_5 = SetDifference(SetA=eval_3.Point, SetB=eval_4.Point)
difference_6 = SetDifference(SetA=eval_5.Point, SetB=eval_6.Point)
mindex_4 = MemberIndex(Set=eval_3.Point, Member=difference_5)  # -> flatten(Index), Count
mindex_5 = MemberIndex(Set=eval_5.Point, Member=difference_6)  # -> flatten(Index), Count
cset = CreateSet(List=mindex_4.Index)  # -> Set, Map
cset_2 = CreateSet(List=mindex_5.Index)  # -> Set, Map
item_6 = ListItem(List=dupln_2, Index=cset.Set, Wrap=False)
item_7 = ListItem(List=dupln_5, Index=cset_2.Set, Wrap=False)
trim_7 = TrimWithRegion(Curve=item_6, Region=pline)  # -> Inside, Outside
trim_8 = TrimWithRegion(Curve=item_7, Region=pline)  # -> Inside, Outside

crv_7 = Curve(scale.Geometry)
crv_8 = Curve(branch_2)
crv_9 = Curve(trim_8.Inside)
crv_10 = Curve(trim_7.Inside)
crv_11 = Curve(cull_10)
item_8 = ListItem(List=crv_9, Index=0, Wrap=True)
number_slider_3 = Slider(5, range=0..16)
number_slider_4 = Slider(10, range=0..16)
item_9 = ListItem(List=crv_11, Index=0, Wrap=True)
flip = FlipCurve(Curve=crv_9, Guide=item_8)  # -> Curve, Flag
flip_2 = FlipCurve(Curve=crv_11, Guide=item_9)  # -> Curve, Flag
dash = DashPattern(Curve=graft(crv_7), Pattern=[number_slider_4, number_slider_3])  # -> Dashes, Gaps
dash_2 = DashPattern(Curve=graft(crv_9), Pattern=[number_slider_4, number_slider_3])  # -> Dashes, Gaps
dash_3 = DashPattern(Curve=graft(flip_2.Curve), Pattern=[number_slider_4, number_slider_3])  # -> Dashes, Gaps

trim_9 = TrimWithRegion(Curve=crv_8, Region=pline)  # -> Inside, Outside
crv_12 = Curve(trim_9.Inside)

# ---- group: RH_OUT:01
crv_13 = Curve(dash.Dashes)

# ---- group: RH_OUT:02
crv_14 = Curve(crv_12)

# ---- group: RH_OUT:03
crv_15 = Curve(dash_2.Dashes)

# ---- group: RH_OUT:04
crv_16 = Curve(crv_10)

# ---- group: RH_OUT:05
crv_17 = Curve(dash_3.Dashes)
