# Grasshopper definition RozvanyUpload02.gh (Grasshopper 1.0.7)
# plug-ins: Kangaroo2 Components

xy = XYPlane(Origin=Point(0, 0, 0))
xy_2 = XYPlane(Origin=Point(0, 0, 0))
xy_3 = XYPlane(Origin=Point(0, 0, 0))

pipeline = GeometryPipeline(
    GroupByLayer=False,
    GroupByType=False,
    IncludeHidden=True,
    IncludeLocked=True,
    LayerFilter="Boundary",
    NameFilter="*",
    SublayerFiltering=False,
    TypeFilter=1073741848)
pipeline_2 = GeometryPipeline(
    GroupByLayer=False,
    GroupByType=False,
    IncludeHidden=True,
    IncludeLocked=True,
    LayerFilter="Point Support",
    NameFilter="*",
    SublayerFiltering=False,
    TypeFilter=1)
pipeline_3 = GeometryPipeline(
    GroupByLayer=False,
    GroupByType=False,
    IncludeHidden=True,
    IncludeLocked=True,
    LayerFilter="Line Support",
    NameFilter="*",
    SublayerFiltering=False,
    TypeFilter=4)

boundary = GetGeometry(pipeline, AtLeast=1, AtMost=2147483647, Filter=1074004029)
points = GetGeometry(pipeline_2, AtLeast=0, AtMost=2147483647, Filter=1074004029)
boundtype = GetInteger(Slider(2, range=0..2), AtLeast=1, AtMost=2147483647, Maximum=2, Minimum=0)
spacing = GetNumber(Slider(10, range=1..20), AtLeast=1, AtMost=2147483647, Maximum=1.797693135e+308, Minimum=-1.797693135e+308)
debrep = DeconstructBrep(Brep=boundary)  # -> Faces, Edges, Vertices

num = Number(flatten(boundtype))
num_2 = Number(flatten(spacing))
pt = Point(flatten(points))
pt_2 = Point(flatten(debrep.Vertices))

lines = GetGeometry(pipeline_3, AtLeast=0, AtMost=2147483647, Filter=1074004029)
join = JoinCurves(Curves=debrep.Edges, Preserve=False)

explode = Explode(Curve=join, Recursive=True)  # -> Segments, Vertices
len = Length(Curve=explode.Segments)
division = Division(A=len, B=num_2)
round = Round(Number=division)  # -> Nearest, Floor, Ceiling
divide = DivideCurve(Curve=explode.Segments, Count=round.Nearest, Kinks=False)  # -> Points, Tangents, Parameters
pline = PolyLine(Vertices=divide.Points, Closed=False)
pt_3 = Point(pt_2)
crv = Curve(pline)

incurve = PointInCurve(Point=pt, Curve=join)  # -> Relationship, Point
equals = Equality(FirstNumber=incurve.Relationship, SecondNumber=2)  # -> Equality, Inequality
cull = CullPattern(List=pt, CullPattern=equals.Equality)
pt_4 = Point(cull)

difference = SetDifference(SetA=divide.Points, SetB=pt_2)
pt_5 = Point(divide.Points)

# ---- group: RH_OUT:00
crv_2 = Curve(join)

# ----
explode_2 = Explode(Curve=lines, Recursive=True)  # -> Segments, Vertices
end = EndPoints(Curve=explode_2.Segments)  # -> Start, End
len_2 = Length(Curve=explode_2.Segments)
merge = Merge(Data1=end.Start, Data2=end.End)
division_2 = Division(A=len_2, B=num_2)
round_2 = Round(Number=division_2)  # -> Nearest, Floor, Ceiling
divide_2 = DivideCurve(Curve=simplify(explode_2.Segments), Count=simplify(round_2.Nearest), Kinks=False)  # -> Points, Tangents, Parameters
incurve_2 = PointInCurve(Point=divide_2.Points, Curve=join)  # -> Relationship, Point
equals_2 = Equality(FirstNumber=incurve_2.Relationship, SecondNumber=2)  # -> Equality, Inequality
cull_2 = CullPattern(List=divide_2.Points, CullPattern=equals_2.Equality)
pt_6 = Point(merge)
crv_3 = Curve(explode_2.Segments)

cullpt = CullDuplicates(Points=cull_2, Tolerance=0.1, CullMode=3)  # -> Points, Indices, Valence
filter = StreamFilter(Gate=num, Stream2=pt_3)
filter_2 = StreamFilter(Gate=num, Stream2=pt_5)

difference_2 = SetDifference(SetA=cullpt.Points, SetB=merge)
pt_7 = Point(difference_2)

merge_2 = Merge(Data1=pt_6, Data2=pt_4)  # -> flatten(Result)
filter_3 = StreamFilter(Gate=num, Stream1=pt_3, Stream2=pt_3)
filter_4 = StreamFilter(Gate=num, Stream2=join)
filter_5 = StreamFilter(Gate=num, Stream1=pt_5, Stream2=pt_5)
merge_3 = Merge(Data1=filter, Data2=merge_2)
entwine = Entwine(Branch0X=simplify(graft(merge_3)), Branch1X=simplify(pt_7), Branch2X=simplify(filter_5), FlattenInputs=False)

pt_8 = Point(entwine)
voronoi = Voronoi(Points=flatten(pt_8), Plane=xy, BruteForceOverride=False)

unflatten = UnflattenTree(Tree=voronoi, Guide=pt_8)
merge_4 = Merge(Data1=unflatten, Data2=unflatten)
runion = RegionUnion(Curves=merge_4)
trim = TrimWithRegion(Curve=runion, Region=join)  # -> Inside, Outside
crv_4 = Curve(flatten(trim.Inside))
explode_3 = Explode(Curve=flatten(crv_4), Recursive=True)  # -> Segments, Vertices
dupln = RemoveDuplicateLines(Lines=flatten(explode_3.Segments), Tolerance=0.01)
colom = CollisionOneMany(Collider=dupln, Obstacles=flatten(crv_3))  # -> Collision, Index
not = GateNot(A=colom.Collision)
cull_3 = CullPattern(List=dupln, CullPattern=not)
join_2 = JoinCurves(Curves=cull_3, Preserve=False)
end_2 = EndPoints(Curve=join_2)  # -> Start, End
cullpt_2 = CullDuplicates(Points=[end_2.Start, end_2.End], Tolerance=0.1, CullMode=3)  # -> Points, Indices, Valence
Z = UnitZ(Factor=1)
line = LineSDL(Start=cullpt_2.Points, Direction=Z, Length=1)
ccx = CurveCurve(CurveA=graft(join_2), CurveB=line)  # -> Points, ParamsA, ParamsB
pshift = ShiftPaths(Data=simplify(ccx.ParamsA), Offset=-1)
shatter = Shatter(Curve=graft(join_2), Parameters=pshift)  # -> flatten(Segments)
len_3 = Length(Curve=crv_3)
division_3 = Division(A=len_3, B=num_2)
incurve_3 = PointInCurve(Point=cullpt_2.Points, Curve=join)  # -> Relationship, Point
round_3 = Round(Number=division_3)  # -> Nearest, Floor, Ceiling
equals_3 = Equality(FirstNumber=incurve_3.Relationship, SecondNumber=1)  # -> Equality, Inequality
divide_3 = DivideCurve(Curve=crv_3, Count=round_3.Nearest, Kinks=False)  # -> Points, Tangents, Parameters
cull_4 = CullPattern(List=cullpt_2.Points, CullPattern=equals_3.Inequality)
pt_9 = Point(divide_3.Points)
pt_10 = Point(pt_6)
pt_11 = Point(cull_4)
difference_3 = SetDifference(SetA=divide_3.Points, SetB=pt_10)
pt_12 = Point(filter_2)

crv_5 = Curve(shatter)

len_4 = Length(Curve=crv_5)
division_4 = Division(A=len_4, B=num_2)
round_4 = Round(Number=division_4)  # -> Nearest, Floor, Ceiling
divide_4 = DivideCurve(Curve=crv_5, Count=round_4.Nearest, Kinks=False)  # -> Points, Tangents, Parameters
pt_13 = Point(divide_4.Points)
difference_4 = SetDifference(SetA=pt_13, SetB=pt_11)
entwine_2 = Entwine(
    Branch0X=simplify(merge_3),
    Branch1X=simplify(pt_11),
    Branch2X=simplify(difference_3),
    Branch3X=simplify(difference_4),
    Branch4X=simplify(pt_12),
    FlattenInputs=False)

pt_14 = Point(entwine_2)
voronoi_2 = Voronoi(Points=flatten(pt_14), BruteForceOverride=False)
trim_2 = TrimWithRegion(Curve=voronoi_2, Region=join)  # -> Inside, Outside
clean = CleanTree(RemoveNulls=True, RemoveInvalid=True, RemoveEmpty=False, Tree=trim_2.Inside)

unflatten_2 = UnflattenTree(Tree=voronoi_2, Guide=pt_14)
tstat = TreeStatistics(Tree=unflatten_2)  # -> Paths, Length, Count
dpath = DeconstructPath(Branch=tstat.Paths)
item = ListItem(List=dpath, Index=0, Wrap=True)
equals_4 = Equality(FirstNumber=item, SecondNumber=Slider(0, range=0..100))  # -> Equality, Inequality
equals_5 = Equality(FirstNumber=item, SecondNumber=Slider(1, range=0..100))  # -> Equality, Inequality
equals_6 = Equality(FirstNumber=item, SecondNumber=Slider(2, range=0..100))  # -> Equality, Inequality
equals_7 = Equality(FirstNumber=item, SecondNumber=Slider(3, range=0..100))  # -> Equality, Inequality
equals_8 = Equality(FirstNumber=item, SecondNumber=Slider(4, range=0..100))  # -> Equality, Inequality
cull_5 = CullPattern(List=graft(tstat.Paths), CullPattern=equals_4.Equality)
cull_6 = CullPattern(List=graft(tstat.Paths), CullPattern=equals_5.Equality)
cull_7 = CullPattern(List=graft(tstat.Paths), CullPattern=equals_6.Equality)
cull_8 = CullPattern(List=graft(tstat.Paths), CullPattern=equals_7.Equality)
cull_9 = CullPattern(List=graft(tstat.Paths), CullPattern=equals_8.Equality)
branch = TreeBranch(Tree=unflatten_2, Path=cull_5, MaintainPaths=True)
branch_2 = TreeBranch(Tree=unflatten_2, Path=cull_6, MaintainPaths=True)
branch_3 = TreeBranch(Tree=unflatten_2, Path=cull_7, MaintainPaths=True)
branch_4 = TreeBranch(Tree=unflatten_2, Path=cull_8, MaintainPaths=True)
branch_5 = TreeBranch(Tree=unflatten_2, Path=cull_9, MaintainPaths=True)
crv_6 = Curve(branch)
trim_3 = TrimWithRegion(Curve=branch_3, Region=join)  # -> Inside, Outside
trim_4 = TrimWithRegion(Curve=branch_4, Region=join)  # -> Inside, Outside
trim_5 = TrimWithRegion(Curve=branch_5, Region=join)  # -> Inside, Outside
trim_6 = TrimWithRegion(Curve=crv_6, Region=join)  # -> Inside, Outside
ccx_2 = CurveCurve(CurveA=join, CurveB=trim_3.Inside)  # -> Points, ParamsA, ParamsB
ccx_3 = CurveCurve(CurveA=join, CurveB=trim_4.Inside)  # -> Points, ParamsA, ParamsB
explode_4 = Explode(Curve=trim_5.Inside, Recursive=True)  # -> Segments, Vertices
crv_7 = Curve(trim_6.Inside)
crv_cp = CurveClosestPoint(Point=flatten(ccx_2.Points), Curve=join)  # -> Point, Parameter, Distance
crv_cp_2 = CurveClosestPoint(Point=flatten(ccx_3.Points), Curve=join)  # -> Point, Parameter, Distance
colom_2 = CollisionOneMany(Collider=explode_4.Segments, Obstacles=filter_4)  # -> Collision, Index
explode_5 = Explode(Curve=crv_7, Recursive=True)  # -> Segments, Vertices
explode_6 = Explode(Curve=crv_6, Recursive=True)  # -> Segments, Vertices
shatter_2 = Shatter(Curve=join, Parameters=crv_cp.Parameter)
cull_10 = CullPattern(List=explode_4.Segments, CullPattern=colom_2.Collision)
shatter_3 = Shatter(Curve=join, Parameters=crv_cp_2.Parameter)
pline_2 = PolyLine(Vertices=explode_6.Vertices, Closed=invert(False))
eval = EvaluateLength(Curve=shatter_2, Length=Slider(0.5, range=0..1), Normalized=True)  # -> Point, Tangent, Parameter
eval_2 = EvaluateLength(Curve=shatter_3, Length=Slider(0.5, range=0..1), Normalized=True)  # -> Point, Tangent, Parameter
incurve_4 = PointInCurve(Point=pt_3, Curve=graft(pline_2))  # -> Relationship, Point
explode_7 = Explode(Curve=branch_4, Recursive=True)  # -> Segments, Vertices
explode_8 = Explode(Curve=branch_3, Recursive=True)  # -> Segments, Vertices
mindex = MemberIndex(Set=incurve_4.Relationship, Member=2)  # -> Index, Count
pline_3 = PolyLine(Vertices=explode_7.Vertices, Closed=invert(False))
pline_4 = PolyLine(Vertices=explode_8.Vertices, Closed=invert(False))
item_2 = ListItem(List=pt_3, Index=mindex.Index, Wrap=True)
incurve_5 = PointInCurve(Point=eval_2.Point, Curve=graft(pline_3))  # -> Relationship, Point
incurve_6 = PointInCurve(Point=eval.Point, Curve=graft(pline_4))  # -> Relationship, Point
merge_5 = Merge(Data1=simplify(explode_5.Vertices), Data2=simplify(item_2))
mindex_2 = MemberIndex(Set=incurve_5.Relationship, Member=2)  # -> Index, Count
mindex_3 = MemberIndex(Set=incurve_6.Relationship, Member=2)  # -> Index, Count
pline_5 = PolyLine(Vertices=merge_5, Closed=invert(False))
panel = Panel("""0.25
0.5
0.75""")
item_3 = ListItem(List=shatter_2, Index=mindex_3.Index, Wrap=True)
item_4 = ListItem(List=shatter_3, Index=mindex_2.Index, Wrap=True)
scale = Scale(Geometry=pline_5, Center=graft(merge_3), Factor=panel)  # -> Geometry, Transform
merge_6 = Merge(Data1=simplify(trim_3.Inside), Data2=simplify(item_3))
merge_7 = Merge(Data1=simplify(trim_4.Inside), Data2=simplify(item_4))
join_3 = JoinCurves(Curves=merge_7, Preserve=False)
number_slider = Slider(0.5, range=0..1)
number_slider_2 = Slider(0.5, range=0..1)

clean_2 = CleanTree(RemoveNulls=True, RemoveInvalid=True, RemoveEmpty=invert(False), Tree=merge_6)
clean_3 = CleanTree(RemoveNulls=True, RemoveInvalid=True, RemoveEmpty=invert(False), Tree=join_3)

pshift_2 = ShiftPaths(Data=clean_3, Offset=-1)
runion_2 = RegionUnion(Curves=flatten(pshift_2), Plane=xy_2)
join_4 = JoinCurves(Curves=clean_2, Preserve=False)
explode_9 = Explode(Curve=runion_2, Recursive=True)  # -> flatten(Segments), Vertices
pshift_3 = ShiftPaths(Data=join_4, Offset=-2)
explode_10 = Explode(Curve=pshift_2, Recursive=True)  # -> flatten(Segments), Vertices
runion_3 = RegionUnion(Curves=pshift_3, Plane=xy_3)
explode_11 = Explode(Curve=pshift_3, Recursive=True)  # -> flatten(Segments), Vertices
explode_12 = Explode(Curve=runion_3, Recursive=True)  # -> flatten(Segments), Vertices

end_3 = EndPoints(Curve=explode_9.Segments)  # -> Start, End
ln = Line(StartPoint=end_3.Start, EndPoint=end_3.End)
end_4 = EndPoints(Curve=explode_10.Segments)  # -> Start, End
end_5 = EndPoints(Curve=explode_12.Segments)  # -> Start, End
end_6 = EndPoints(Curve=explode_11.Segments)  # -> Start, End
ln_2 = Line(StartPoint=end_4.Start, EndPoint=end_4.End)
ln_3 = Line(StartPoint=end_5.Start, EndPoint=end_5.End)
ln_4 = Line(StartPoint=end_6.Start, EndPoint=end_6.End)

dupln_2 = RemoveDuplicateLines(Lines=ln_2, Tolerance=0.01)
dupln_3 = RemoveDuplicateLines(Lines=ln, Tolerance=0.01)
dupln_4 = RemoveDuplicateLines(Lines=ln_3, Tolerance=0.01)
dupln_5 = RemoveDuplicateLines(Lines=ln_4, Tolerance=0.01)
eval_3 = EvaluateLength(Curve=dupln_2, Length=number_slider, Normalized=True)  # -> Point, Tangent, Parameter
eval_4 = EvaluateLength(Curve=dupln_3, Length=number_slider, Normalized=True)  # -> Point, Tangent, Parameter
eval_5 = EvaluateLength(Curve=dupln_5, Length=number_slider_2, Normalized=True)  # -> Point, Tangent, Parameter
eval_6 = EvaluateLength(Curve=dupln_4, Length=number_slider_2, Normalized=True)  # -> Point, Tangent, Parameter
difference_5 = SetDifference(SetA=eval_3.Point, SetB=eval_4.Point)
difference_6 = SetDifference(SetA=eval_5.Point, SetB=eval_6.Point)
mindex_4 = MemberIndex(Set=eval_3.Point, Member=difference_5)  # -> flatten(Index), Count
mindex_5 = MemberIndex(Set=eval_5.Point, Member=difference_6)  # -> flatten(Index), Count
cset = CreateSet(List=mindex_4.Index)  # -> Set, Map
cset_2 = CreateSet(List=mindex_5.Index)  # -> Set, Map
item_5 = ListItem(List=dupln_2, Index=cset.Set, Wrap=False)
item_6 = ListItem(List=dupln_5, Index=cset_2.Set, Wrap=False)
trim_7 = TrimWithRegion(Curve=item_5, Region=join)  # -> Inside, Outside
trim_8 = TrimWithRegion(Curve=item_6, Region=join)  # -> Inside, Outside

crv_8 = Curve(scale.Geometry)
crv_9 = Curve(branch_2)
crv_10 = Curve(trim_8.Inside)
crv_11 = Curve(trim_7.Inside)
crv_12 = Curve(cull_10)
item_7 = ListItem(List=crv_10, Index=0, Wrap=True)
number_slider_3 = Slider(0.5, range=0..16)
number_slider_4 = Slider(1, range=0..16)
item_8 = ListItem(List=crv_12, Index=0, Wrap=True)
flip = FlipCurve(Curve=crv_10, Guide=item_7)  # -> Curve, Flag
flip_2 = FlipCurve(Curve=crv_12, Guide=item_8)  # -> Curve, Flag

merge_8 = Merge(Data1=crv_8, Data2=flip.Curve, Data3=flip_2.Curve)
len_5 = Length(Curve=merge_8)
sort = SortList(Keys=flatten(len_5))  # -> Keys, ValuesA
larger = LargerThan(FirstNumber=sort.Keys, SecondNumber="1")  # -> LargerThan, OrEqualTo
trim_9 = TrimWithRegion(Curve=crv_9, Region=join)  # -> Inside, Outside
dispatch = Dispatch(List=sort.Keys, DispatchPattern=larger.LargerThan)  # -> ListA, ListB
crv_13 = Curve(trim_9.Inside)
item_9 = ListItem(List=flatten(dispatch.ListA), Index=0, Wrap=True)
division_5 = Division(A=item_9, B="3")
multiplication = Multiplication(A=division_5, B=Slider(0.33, range=0..1))

# ---- group: RH_OUT:02
crv_14 = Curve(crv_13)

# ---- group: RH_OUT:04
crv_15 = Curve(crv_11)

# ----
multiplication_2 = Multiplication(A=division_5, B=Slider(0.66, range=0..1))

dash = DashPattern(Curve=graft(flip_2.Curve), Pattern=[multiplication_2, multiplication])  # -> Dashes, Gaps
dash_2 = DashPattern(Curve=graft(crv_8), Pattern=[multiplication_2, multiplication])  # -> Dashes, Gaps
dash_3 = DashPattern(Curve=graft(crv_10), Pattern=[multiplication_2, multiplication])  # -> Dashes, Gaps

# ---- group: RH_OUT:03
crv_16 = Curve(dash_3.Dashes)

# ---- group: RH_OUT:05
crv_17 = Curve(dash.Dashes)

# ---- group: RH_OUT:01
crv_18 = Curve(dash_2.Dashes)
