# Grasshopper definition geo_upload.gh (Grasshopper 1.0.7)

geo = Geometry([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])
geo_2 = Geometry([<point referenced from the Rhino model> x4])
breps = Geometry([<brep referenced from the Rhino model> x2])
lines = GetGeometry(geo, AtLeast=1, AtMost=1, DeleteInput=False, Filter=1074004029)
points = GetGeometry(geo_2, AtLeast=1, AtMost=1, DeleteInput=False, Filter=1074004029)
breps_2 = GetGeometry(breps, AtLeast=1, AtMost=1, DeleteInput=False, Filter=1074004029)
end = EndPoints(Curve=lines)  # -> Start, End
del = DelaunayMesh(Points=points, Plane=PlaneXY(0, 0, 0))
del_2 = DelaunayMesh(Points=[end.Start, end.End], Plane=PlaneXY(0, 0, 0))
medges = MeshEdges(Mesh=del)  # -> NakedEdges, InteriorEdges, NonManifoldEdges
scale = Scale(Geometry=breps_2, Center=Point(0, 0, 0), Factor=0.5)  # -> Geometry, Transform

# ---- group: RH_OUT:crvs
crv = Curve([medges.NakedEdges, medges.InteriorEdges])

# ---- group: RH_OUT:mesh
mesh = Mesh(del_2)

# ---- group: RH_OUT:breps
mesh_2 = Mesh(scale.Geometry)
